# Grasshopper definition IiA_Piglet_Earthworm_Script.gh (Grasshopper 1.0.8)
# Copyright: Arup
# plug-ins: Human UI, EarthwormGrasshopper, EleFront, PancakeSpreadsheet, HFTidyCanvas

default_folder = Panel("C:\")
txt = Text(default_folder)
label = CreateLabel(LabelText="Browse the input file to use", LabelSize=18, Justification=0)
filepicker = CreateFilePicker(ButtonLabelText="Browse", DialogType="0", MustExist=True, Filter="All Files|*.*", StartingPath=txt)
values = ValueListener(Elements=filepicker, SomeProperty=True)  # -> Values, Indices
stack = CreateStack(UIElements=[label, filepicker], Horizontal=True)
tooltip = AttachTooltipToElement(ElementsToAttachTo=stack, ShowDelay=500, Duration=2000)
adjustpos = AdjustElementPositioning(ElementsToAdjust=filepicker, AbsolutePositioning=False, Width="400", Height="31", HorizontalAlignment=0)
adjustpos_2 = AdjustElementPositioning(ElementsToAdjust=label, Margin="0,10,0,0", AbsolutePositioning=False, Width="210")

input_piglet_excel_file = Panel(values.Values)

minimize = BooleanToggle(True)
python = GhPythonScript(x=minimize)  # -> out, a
# ---------- python: Python ----------
__author__ = "Giandomenico.Azzone"
__version__ = "2024.03.02"

import rhinoscriptsyntax as rs

if x == True:
    rs.Command("Minimize")
# ---------- end python ----------
number_of_pile_discretization_nodes_or_n = Panel("32")  # "Number of pile discretization nodes - or - Number of nodes in the pile node results"

_2_lettura_input_excel = BooleanToggle(False)  # disabled
_3_run_analysis = BooleanToggle(False)  # disabled
_5_visualization = BooleanToggle(False)  # disabled
_4_plot_charts = BooleanToggle(False)  # disabled
_1_input_piglet_excel_file = FilePath("C:\ARUP\proj\piglet\24.03.01\v1\Test_piglet_input.xlsx")  # disabled

# ----
# Automatic Output file path
panel = Panel("\")
split = TextSplit(Text=values.Values, Separators=panel)
cull_i = CullIndex(List=split, Indices=-1, Wrap=True)
join = TextJoin(Text=cull_i, Join=panel)
concat = Concatenate(FragmentA=join, FragmentC=panel, FragmentB="Piglet_Output")
file_path = Panel(concat)

colonna = Panel("3")
index_of_the_1st_data = Panel("8")
index_of_the_2nd_data = Panel("19")
gap_betw_data = Panel("14")

riga = Panel("19")
index_of_the_1st_data_2 = Panel("16")
index_of_the_2nd_data_2 = Panel("30")
gap_betw_data_2 = Panel("14")

colonna_2 = Panel("11")
index_of_the_1st_data_3 = Panel("8")
index_of_the_2nd_data_3 = Panel("27")
gap_betw_data_3 = Panel("14")

riga_2 = Panel("17")
index_of_the_2nd_data_4 = Panel("30")
index_of_the_1st_data_4 = Panel("16")
gap_betw_data_4 = Panel("14")

riga_3 = Panel("18")
index_of_the_2nd_data_5 = Panel("30")
index_of_the_1st_data_5 = Panel("16")
gap_betw_data_5 = Panel("14")

colonna_3 = Panel("4")
index_of_the_1st_data_6 = Panel("8")
index_of_the_2nd_data_6 = Panel("20")
gap_betw_data_6 = Panel("14")

riga_4 = Panel("16")
index_of_the_2nd_data_7 = Panel("30")
index_of_the_1st_data_7 = Panel("16")
gap_betw_data_7 = Panel("14")

riga_5 = Panel("15")
index_of_the_2nd_data_8 = Panel("30")
index_of_the_1st_data_8 = Panel("16")
gap_betw_data_8 = Panel("14")

colonna_4 = Panel("10")
index_of_the_1st_data_9 = Panel("8")
index_of_the_2nd_data_9 = Panel("26")
gap_betw_data_9 = Panel("14")

riga_6 = Panel("7")
index_of_the_2nd_data_10 = Panel("30")
index_of_the_1st_data_10 = Panel("16")
gap_betw_data_10 = Panel("14")

index_of_the_1st_data_11 = Panel("16")
gap_betw_data_11 = Panel("14")
riga_7 = Panel("8")
index_of_the_2nd_data_11 = Panel("30")

riga_8 = Panel("9")
index_of_the_2nd_data_12 = Panel("30")
index_of_the_1st_data_12 = Panel("16")
gap_betw_data_12 = Panel("14")

riga_9 = Panel("10")
index_of_the_1st_data_13 = Panel("16")
index_of_the_2nd_data_13 = Panel("30")
gap_betw_data_13 = Panel("14")

index_of_the_1st_data_14 = Panel("16")
riga_10 = Panel("11")
index_of_the_2nd_data_14 = Panel("30")
gap_betw_data_14 = Panel("14")

riga_11 = Panel("12")
index_of_the_2nd_data_15 = Panel("30")
gap_betw_data_15 = Panel("14")
index_of_the_1st_data_15 = Panel("16")

riga_12 = Panel("6")
index_of_the_1st_data_16 = Panel("16")
index_of_the_2nd_data_16 = Panel("30")
gap_betw_data_16 = Panel("14")

colonna_5 = Panel("6")
index_of_the_1st_data_17 = Panel("8")
index_of_the_2nd_data_17 = Panel("22")
gap_betw_data_17 = Panel("14")

colonna_6 = Panel("5")
index_of_the_1st_data_18 = Panel("8")
index_of_the_2nd_data_18 = Panel("21")
gap_betw_data_18 = Panel("14")

riga_13 = Panel("4")
index_of_the_1st_data_19 = Panel("4")
index_of_the_2nd_data_19 = Panel("20")
gap_betw_data_19 = Panel("14")

riga_14 = Panel("13")
index_of_the_1st_data_20 = Panel("16")
index_of_the_2nd_data_20 = Panel("30")
gap_betw_data_20 = Panel("14")

colonna_7 = Panel("9")
index_of_the_1st_data_21 = Panel("8")
index_of_the_2nd_data_21 = Panel("25")
gap_betw_data_21 = Panel("14")

colonna_8 = Panel("7")
index_of_the_1st_data_22 = Panel("8")
index_of_the_2nd_data_22 = Panel("23")
gap_betw_data_22 = Panel("14")

colonna_9 = Panel("126")
index_of_the_1st_data_23 = Panel("11")

riga_15 = Panel("21")
index_of_the_1st_data_24 = Panel("16")
index_of_the_2nd_data_23 = Panel("30")
gap_betw_data_23 = Panel("14")

colonna_10 = Panel("125")
index_of_the_1st_data_25 = Panel("11")

# ----
# Load Case Names: LC A
# LC B
# LC C
# LC D
# LC E
# LC F
# LC A
# LC B
# LC C
# LC D
# LC E
# LC F
colonna_11 = Panel("124")
# Load Types: -1: non-linear analysis, inputs are loads
#  1: rigid pile-cap, inputs are loads
#  2: rigid pile-cap, inputs are deflections
#  3: flexible pile-cap, inputs are loads
#  4: flexible pile-cap, inputs are deflections
index_of_the_1st_data_26 = Panel("11")

riga_16 = Panel("20")
index_of_the_1st_data_27 = Panel("16")
index_of_the_2nd_data_24 = Panel("30")
gap_betw_data_24 = Panel("14")

colonna_12 = Panel("129")
index_of_the_1st_data_28 = Panel("11")

colonna_13 = Panel("131")
index_of_the_1st_data_29 = Panel("11")

colonna_14 = Panel("128")
index_of_the_1st_data_30 = Panel("11")

colonna_15 = Panel("127")
index_of_the_1st_data_31 = Panel("11")

colonna_16 = Panel("130")
index_of_the_1st_data_32 = Panel("11")

test_piles_iterat_simulation = ValueList({"1", "2", "3", "4", "10"}, selected="3")  # disabled
test_ground_iterat_simulation = ValueList({"1", "2", "3", "4"}, selected="3")  # disabled

piglet_json_version_always_1 = ValueList({"0", "1"}, selected="1")
int = Integer(piglet_json_version_always_1)

label_2 = CreateLabel(LabelText="You can find the Piglet Charts here:", LabelSize="17", Justification=0)

togglevisibilityimported = CreateToggle(Default=False)
label_3 = CreateLabel(LabelText="Turn ON to Read Piglet Inputs", LabelSize=12, Justification=0)
values_2 = ValueListener(Elements=togglevisibilityimported, SomeProperty=True)  # -> Values, Indices
adjustelem = AdjustElementAppearance(ElementsToAdjust=label_3, FontSize="16")
adjustpos_3 = AdjustElementPositioning(ElementsToAdjust=label_3, Margin="0,2,0,0", AbsolutePositioning=False, Width="230")

togglevisibilityimported_2 = CreateToggle(Default=False)
label_4 = CreateLabel(LabelText="Turn ON to Run Piglet Analysis", LabelSize=12, Justification=0)
stack_2 = CreateStack(UIElements=[label_4, togglevisibilityimported_2], Horizontal=True)
values_3 = ValueListener(Elements=togglevisibilityimported_2, SomeProperty=True)  # -> Values, Indices
adjustelem_2 = AdjustElementAppearance(ElementsToAdjust=label_4, FontSize="16")
adjustpos_4 = AdjustElementPositioning(ElementsToAdjust=label_4, Margin="0,2,0,0", AbsolutePositioning=False, Width="230")
hideshow = HideShowElement(ElementToHideShow=stack_2, Show=True, Collapse=True, Disable=invert(values_2.Values))

togglevisibilityimported_3 = CreateToggle(Default=False)
label_5 = CreateLabel(LabelText="Turn ON to Plot Piglet Charts", LabelSize=12, Justification=0)
stack_3 = CreateStack(UIElements=[label_5, togglevisibilityimported_3], Horizontal=True)
values_4 = ValueListener(Elements=togglevisibilityimported_3, SomeProperty=True)  # -> Values, Indices
adjustelem_3 = AdjustElementAppearance(ElementsToAdjust=label_5, FontSize="16")
adjustpos_5 = AdjustElementPositioning(ElementsToAdjust=label_5, Margin="0,2,0,0", AbsolutePositioning=False, Width="230")
and = GateAnd(A=values_2.Values, B=values_3.Values)
hideshow_2 = HideShowElement(ElementToHideShow=stack_3, Show=True, Collapse=True, Disable=invert(and))

togglevisibilityimported_4 = CreateToggle(Default=False)
label_6 = CreateLabel(LabelText="Turn ON to Export Piglet Charts", LabelSize=12, Justification=0)
stack_4 = CreateStack(UIElements=[label_6, togglevisibilityimported_4], Horizontal=True)
values_5 = ValueListener(Elements=togglevisibilityimported_4, SomeProperty=True)  # -> Values, Indices
adjustelem_4 = AdjustElementAppearance(ElementsToAdjust=label_6, FontSize="16")
adjustpos_6 = AdjustElementPositioning(ElementsToAdjust=label_6, Margin="0,2,0,0", AbsolutePositioning=False, Width="230")
and_2 = GateAnd(A=values_2.Values, B=values_3.Values, C=values_4.Values)
hideshow_3 = HideShowElement(ElementToHideShow=stack_4, Show=True, Collapse=True, Disable=invert(and_2))

int_2 = Integer("4")
int_3 = Integer("2")
int_4 = Integer("3")
int_5 = Integer("3")
int_6 = Integer("1")
pssimpleread = SimpleReadXLSX(File=values.Values, SheetIdentifier=int_3, RowFirst=invert(True), OK=values_2.Values)
pssimpleread_2 = SimpleReadXLSX(File=values.Values, SheetIdentifier=int_4, RowFirst=invert(True), OK=values_2.Values)
pssimpleread_3 = SimpleReadXLSX(File=values.Values, SheetIdentifier=int_5, RowFirst=True, OK=values_2.Values)
pssimpleread_4 = SimpleReadXLSX(File=values.Values, SheetIdentifier=int_2, RowFirst=invert(True), OK=values_2.Values)
panel_2 = Panel(pssimpleread_3)
pssimpleread_5 = SimpleReadXLSX(File=values.Values, SheetIdentifier=int_6, RowFirst=invert(True), OK=values_2.Values)
panel_3 = Panel(pssimpleread)
panel_4 = Panel(pssimpleread_5)
data = Data(pssimpleread_4)
data_2 = Data(pssimpleread_5)

data_3 = Data(pssimpleread_2)
data_4 = Data(pssimpleread_3)

panel_5 = Panel(values_5.Values)

label_7 = CreateLabel(LabelText="Done!", LabelSize="17", Justification=0)
adjustelem_5 = AdjustElementAppearance(ElementsToAdjust=label_7, Foreground=ColourSwatch(SwatchColor=RGB(52, 184, 0)))
adjustpos_7 = AdjustElementPositioning(ElementsToAdjust=label_7, Margin="0,2,0,0", AbsolutePositioning=False)

stack_5 = CreateStack(UIElements=[label_3, togglevisibilityimported, label_7], Horizontal=True)

accent_colors = ValueList({"Amber", "Blue", "Brown", "Cobalt", "Crimson", "Cyan", "Emerald", "Green", "Indigo", "Lime", "Magenta", "Mauve", "Olive", "Orange", "Pink", "Purple", "Red", "Sienna", "Steel", "Taupe", "Teal", "Violet", "Yellow"}, selected="Olive")
launchwin = LaunchWindow(
    Show=Toggle(True),
    Name="Piglet Automation",
    Width="700",
    Height="450",
    FontFamily="Times New Roman",
    ChildStatus=2,
    EnableHorizScroll=False)
minimize_2 = BooleanToggle(True)
keep_active = BooleanToggle(False)
minimzeghwindow = CSharpScript(Minimize=minimize_2, Keep_active=keep_active)  # inputs Minimize: Boolean, Keep_active: Boolean
# ---------- minimzeghwindow: C# ----------
    if(Minimize) Grasshopper.Instances.DocumentEditor.WindowState = System.Windows.Forms.FormWindowState.Minimized;
    else Grasshopper.Instances.DocumentEditor.WindowState = System.Windows.Forms.FormWindowState.Normal;
    if(Keep_active) this.Component.ExpireSolution(true);
# ---------- end minimzeghwindow ----------
winprops = SetWindowProperties(Window=launchwin, StartingLocation="10,10", Theme=0, AccentColor=accent_colors, ShowTitleBar=True, ScaleFactor=1)

# ----
# automatic creation of folder for output
python_2 = GhPythonScript(x=values.Values, y=values_2.Values)  # -> out, a
# ---------- python_2: Python ----------
__author__ = "Giandomenico.Azzone"
__version__ = "2023.12.22"

import rhinoscriptsyntax as rs
if x != None and y ==True: # or x is not;"": 
    a = True
    """
elif x != "":
    a = True
    """
else:
    a = False
print(x)
print(a)
# ---------- end python_2 ----------
panel_6 = Panel(python_2.a)

concat_2 = Concatenate(FragmentA=file_path, FragmentB="\JSON")
concat_3 = Concatenate(FragmentA=file_path, FragmentB="\DIAGRAMS")
createfolder = CSharpScript(path=concat_2, create=python_2.a)  # -> out, A, B; inputs path: String, create: Boolean
# ---------- createfolder: C# usings ----------
using System.IO;
using System.Linq;
using System.Data;
using System.Drawing;
using System.Reflection;
using System.Windows.Forms;
using System.Xml;
using System.Xml.Linq;
using System.Runtime.InteropServices;

using Rhino.DocObjects;
using Rhino.Collections;
using GH_IO;
using GH_IO.Serialization;
# ---------- createfolder: C# ----------
    {
      if (create)
      {
        if (!System.IO.Directory.Exists(path))
        {
          System.IO.Directory.CreateDirectory(path);
          A = true; // Set A to true if directory creation is successful
          B = path; // Set B to the created directory path
        }
        else
        {
          A = true; // Set A to false if the directory already exists
          B = path; // Set B to the existing directory path
        }
      }
      else
      {
        A = false; // Set A to false if directory creation is not requested
        B = null; // Set B to null if directory creation is not requested
      }
    }
# ---------- end createfolder ----------
createfolder_2 = CSharpScript(path=concat_3, create=python_2.a)  # -> out, A, B; inputs path: String, create: Boolean; same code as createfolder

panel_7 = Panel(createfolder.A)
panel_8 = Panel(createfolder.B)
panel_9 = Panel(createfolder_2.B)
and_3 = GateAnd(A=values_3.Values, B=panel_7, C=values_2.Values)
panel_10 = Panel(and_3)
bool = Boolean(and_3)

label_8 = CreateLabel(LabelText=panel_9, LabelSize="17", Justification=0)
adjustelem_6 = AdjustElementAppearance(ElementsToAdjust=[label_2, label_8], Foreground=ColourSwatch(SwatchColor=RGB(52, 184, 0)))
adjustpos_8 = AdjustElementPositioning(ElementsToAdjust=[label_2, label_8], Margin="0,2,0,0", AbsolutePositioning=False)
hideshow_4 = HideShowElement(ElementToHideShow=[label_2, label_8], Show=values_5.Values, Collapse=True, Disable=False)
merge = Merge(Data1=flatten(label_2), Data2=flatten(label_8))
stack_6 = CreateStack(UIElements=merge, Horizontal=invert(True))

merge_2 = Merge(Data1=flatten(stack_3), Data2=flatten(stack_4), Data3=flatten(stack_6))
expander = CreateExpander(UIElements=merge_2, Open=True)
setexp = SetExpander(Expander=expander, Name="Charts and Visualization")

# ----
# copy from main folder Excel and .EXE
panel_11 = Panel("_")
temp = ValueList({"no macro": 0, "macro": 1}, selected="no macro")
and_4 = GateAnd(B=panel_7, C=values_2.Values)

overwrite = BooleanToggle(True)
always_false = BooleanToggle(False)
data_5 = Data(always_false)
file_path_2 = FilePath(createfolder.B)
overwrite_2 = BooleanToggle(overwrite)

tstat = TreeStatistics(Tree=pssimpleread)  # -> Paths, Length, Count
item = ListItem(List=tstat.Paths, Index="1", Wrap=True)
branch = TreeBranch(Tree=pssimpleread, Path=item, MaintainPaths=True)

tstat_2 = TreeStatistics(Tree=data_3)  # -> Paths, Length, Count
item_2 = ListItem(List=tstat_2.Paths, Index="1", Wrap=True)
branch_2 = TreeBranch(Tree=data_3, Path=item_2, MaintainPaths=True)

tstat_3 = TreeStatistics(Tree=data_2)  # -> Paths, Length, Count
item_3 = ListItem(List=tstat_3.Paths, Index="1", Wrap=True)
branch_3 = TreeBranch(Tree=data_2, Path=item_3, MaintainPaths=True)

colonna_17 = Panel("8")
index_of_the_1st_data_33 = Panel("8")
index_of_the_2nd_data_25 = Panel("24")
gap_betw_data_25 = Panel("14")

# ----
# Ground_characterisation
panel_12 = Panel("4")

tstat_4 = TreeStatistics(Tree=pssimpleread)  # -> Paths, Length, Count
item_4 = ListItem(List=tstat_4.Paths, Index=panel_12, Wrap=True)
branch_4 = TreeBranch(Tree=pssimpleread, Path=item_4, MaintainPaths=True)

tstat_5 = TreeStatistics(Tree=pssimpleread)  # -> Paths, Length, Count
item_5 = ListItem(List=tstat_5.Paths, Index="3", Wrap=True)
branch_5 = TreeBranch(Tree=pssimpleread, Path=item_5, MaintainPaths=True)

item_6 = ListItem(List=branch_3, Index=0, Wrap=True)
item_7 = ListItem(List=branch, Index=0, Wrap=True)
item_8 = ListItem(List=branch_2, Index=0, Wrap=True)
iteration_of_piles_from_excel = Panel(item_8)
title_of_analysis_from_excel = Panel(item_6)
iteration_of_ground_from_excel = Panel(item_7)

ground_iter = Integer(iteration_of_ground_from_excel)
piles_iter = Integer(iteration_of_piles_from_excel)

ground_series = Series(Start=1, Step=1, Count=ground_iter)  # -> graft(Series)
pile_series = Series(Start=1, Step=1, Count=piles_iter)
concat_4 = Concatenate(FragmentA="GroundOpt", FragmentB=ground_series, FragmentC="_PilesOpt", FragmentD=pile_series)  # -> simplify(Result)
flatten = FlattenTree(Tree=concat_4, Path="{0}")

split_2 = TextSplit(Text=flatten, Separators="_")
item_9 = ListItem(List=reverse(split_2), Index=0, Wrap=True)  # -> flatten(Item)

# ----
# SOIL DATA NON LINEAR
ground = GROUND(
    relay=data_4,
    i=riga_5,
    i_2=index_of_the_1st_data_8,
    L=piles_iter,
    S=index_of_the_2nd_data_8,
    N=gap_betw_data_8,
    A=ground_iter)
ground_2 = GROUND(
    relay=data_4,
    i=riga_4,
    i_2=index_of_the_1st_data_7,
    L=piles_iter,
    S=index_of_the_2nd_data_7,
    N=gap_betw_data_7,
    A=ground_iter)
ground_3 = GROUND(
    relay=data_4,
    i=riga_2,
    i_2=index_of_the_1st_data_4,
    L=piles_iter,
    S=index_of_the_2nd_data_4,
    N=gap_betw_data_4,
    A=ground_iter)
ground_4 = GROUND(
    relay=data_4,
    i=riga_3,
    i_2=index_of_the_1st_data_5,
    L=piles_iter,
    S=index_of_the_2nd_data_5,
    N=gap_betw_data_5,
    A=ground_iter)
ground_5 = GROUND(
    relay=data_4,
    i=riga,
    i_2=index_of_the_1st_data_2,
    L=piles_iter,
    S=index_of_the_2nd_data_2,
    N=gap_betw_data_2,
    A=ground_iter)
lateral_normalised_disp_to_halve_stiffne = Panel(ground_3)  # "Lateral: Normalised disp. to halve stiffness, (u0/d)50"
axial_hyperbolic_power_g = Panel(ground_2)
lateral_hyperbolic_power_p = Panel(ground_4)
number_of_load_steps = Panel(ground_5)
axial_hyperbolic_constant_f = Panel(ground)
f = AxialHyperbolicConstantF(axial_hyperbolic_constant_f)
g = AxialHyperbolicPowerG(axial_hyperbolic_power_g)
u0_d_50 = LateralNormalisedDispToHalveStiffnessU0D50(lateral_normalised_disp_to_halve_stiffne)
p = LateralHyperbolicPowerG(lateral_hyperbolic_power_p)
inc = NumberOfLoadSteps(number_of_load_steps)
f_2 = F(f)
g_2 = G(g)
u0_d_50_2 = U0D50(u0_d_50)
p_2 = P(p)
inc_2 = Inc(inc)
f_3 = F(f_2)
g_3 = G(g_2)
u0_d_50_3 = U0D50(u0_d_50_2)
p_3 = P(p_2)
inc_3 = Inc(inc_2)

panel_13 = Panel(item_9)

index_of_the_data = Panel("6")
gap_betw_data_26 = Panel("9")
series = Series(Start=index_of_the_data, Step=gap_betw_data_26, Count=ground_iter)
item_10 = ListItem(List=branch_4, Index=series, Wrap=True)  # -> simplify(flatten(Item))

index_of_the_data_2 = Panel("7")
gap_betw_data_27 = Panel("9")
series_2 = Series(Start=index_of_the_data_2, Step=gap_betw_data_27, Count=ground_iter)
item_11 = ListItem(List=branch_4, Index=series_2, Wrap=True)  # -> simplify(flatten(Item))

index_of_the_data_3 = Panel("4")
gap_betw_data_28 = Panel("9")
series_3 = Series(Start=index_of_the_data_3, Step=gap_betw_data_28, Count=ground_iter)
item_12 = ListItem(List=branch_4, Index=series_3, Wrap=True)  # -> simplify(flatten(Item))

index_of_the_data_4 = Panel("5")
gap_betw_data_29 = Panel("9")
series_4 = Series(Start=index_of_the_data_4, Step=gap_betw_data_29, Count=ground_iter)
item_13 = ListItem(List=branch_4, Index=series_4, Wrap=True)  # -> simplify(flatten(Item))

index_of_the_data_5 = Panel("3")
gap_betw_data_30 = Panel("9")
series_5 = Series(Start=index_of_the_data_5, Step=gap_betw_data_30, Count=ground_iter)
item_14 = ListItem(List=branch_4, Index=series_5, Wrap=True)  # -> simplify(flatten(Item))

index_of_the_data_6 = Panel("1")
gap_betw_data_31 = Panel("9")
series_6 = Series(Start=index_of_the_data_6, Step=gap_betw_data_31, Count=ground_iter)
item_15 = ListItem(List=branch_5, Index=series_6, Wrap=True)  # -> simplify(flatten(Item))

index_of_the_data_7 = Panel("2")
gap_betw_data_32 = Panel("9")
series_7 = Series(Start=index_of_the_data_7, Step=gap_betw_data_32, Count=ground_iter)
item_16 = ListItem(List=branch_4, Index=series_7, Wrap=True)  # -> simplify(flatten(Item))

num = Number(f_3)
num_2 = Number(p_3)
num_3 = Number(g_3)
num_4 = Number(u0_d_50_3)
int_7 = Integer(inc_3)

tstat_6 = TreeStatistics(Tree=data_2)  # -> Paths, Length, Count

# ----
# DESCRIPTION AND SCOPE
panel_14 = Panel("_iteration")
analysis_description = Panel(flatten)
int_8 = Integer(number_of_pile_discretization_nodes_or_n)
graft = GraftTree(Tree=analysis_description, IncludeEmptyLists=True, IncludeNullItems=True)  # -> simplify(Tree)

item_17 = ListItem(List=tstat_6.Paths, Index="1", Wrap=True)
branch_6 = TreeBranch(Tree=data_2, Path=item_17, MaintainPaths=True)

# ----
# LOAD CASES
panel_15 = Panel(", Load Type ")  # disabled

item_18 = ListItem(List=branch_6, Index=2, Wrap=True)  # -> simplify(flatten(Item))
scope_1_vertical_loading_2_x_z_plane_3_6 = Panel(item_18)  # "Scope: (1) vertical loading, (2) x:z plane, (3) 6 degrees of freedom"
int_9 = Integer(scope_1_vertical_loading_2_x_z_plane_3_6)

multiplication = Multiplication(A=ground_iter, B=piles_iter)
series_8 = Series(Start=1, Step=1, Count=multiplication)
concat_5 = Concatenate(FragmentA=title_of_analysis_from_excel, FragmentE="_iteration", FragmentD=series_8, FragmentB=".json")  # -> simplify(flatten(Result))
file_name_s_output_title_of_analysis_jso = Panel(concat_5)  # "File name(s) output - Title of analysis .json for eathworm"

# ----
# PILE DATA
piles_1 = PILES_1(
    relay=data_4,
    i=riga_12,
    i_2=index_of_the_1st_data_16,
    L=multiplication,
    S=index_of_the_2nd_data_16,
    N=gap_betw_data_16,
    A=piles_iter)
piles_1_2 = PILES_1(
    relay=data_4,
    i=riga_14,
    i_2=index_of_the_1st_data_20,
    L=multiplication,
    S=index_of_the_2nd_data_20,
    N=gap_betw_data_20,
    A=piles_iter)
piles_1_3 = PILES_1(
    relay=data_4,
    i=riga_13,
    i_2=index_of_the_1st_data_19,
    L=multiplication,
    S=index_of_the_2nd_data_19,
    N=gap_betw_data_19,
    A=piles_iter)
piles_1_4 = PILES_1(
    relay=data_4,
    i=riga_6,
    i_2=index_of_the_1st_data_10,
    L=multiplication,
    S=index_of_the_2nd_data_10,
    N=gap_betw_data_10,
    A=piles_iter)
piles_1_5 = PILES_1(
    relay=data_4,
    i=riga_7,
    i_2=index_of_the_1st_data_11,
    L=multiplication,
    S=index_of_the_2nd_data_11,
    N=gap_betw_data_11,
    A=piles_iter)
piles_1_6 = PILES_1(
    relay=data_4,
    i=riga_8,
    i_2=index_of_the_1st_data_12,
    L=multiplication,
    S=index_of_the_2nd_data_12,
    N=gap_betw_data_12,
    A=piles_iter)
piles_1_7 = PILES_1(
    relay=data_4,
    i=riga_9,
    i_2=index_of_the_1st_data_13,
    L=multiplication,
    S=index_of_the_2nd_data_13,
    N=gap_betw_data_13,
    A=piles_iter)
piles_1_8 = PILES_1(
    relay=data_4,
    i=riga_10,
    i_2=index_of_the_1st_data_14,
    L=multiplication,
    S=index_of_the_2nd_data_14,
    N=gap_betw_data_14,
    A=piles_iter)
piles_1_9 = PILES_1(
    relay=data_4,
    i=riga_11,
    i_2=index_of_the_1st_data_15,
    L=multiplication,
    S=index_of_the_2nd_data_15,
    N=gap_betw_data_15,
    A=piles_iter)
free_standing_length_lf = Panel(piles_1)
axial_young_s_modulus_free_standing_part = Panel(piles_1_4)  # "Axial: Young's modulus free-standing part, Epaf"
axial_young_s_modulus_embedded_part_epa = Panel(piles_1_5)
lateral_x_z_plane_young_s_modulus_free_s = Panel(piles_1_6)  # "Lateral (x-z plane): Young's modulus free-standing part, Eplxf"
lateral_y_z_plane_young_s_modulus_free_s = Panel(piles_1_8)  # "Lateral (y-z plane): Young's modulus free-standing part, Eplyf"
lateral_y_z_plane_young_s_modulus_embedd = Panel(piles_1_9)  # "Lateral (y-z plane): Young's modulus: embedded part, Eply"
ratio_tensile_compressive_axial_capacity = Panel(piles_1_3)
lateral_x_z_plane_young_s_modulus_embedd = Panel(piles_1_7)  # "Lateral (x-z plane): Young's modulus: embedded part, Eplx"
pile_cap_fixity_ranges_from_0_pinned_to = Panel(piles_1_2)  # "Pile cap fixity: ranges from 0 (pinned) to 1 (fixed to pile-cap)"
eplxf = LateralXZPlaneYoungsModulusFreeStandingPartEplxf(lateral_x_z_plane_young_s_modulus_free_s)
eplx = LateralXZPlaneYoungsModulusEmbeddedPartEplx(lateral_x_z_plane_young_s_modulus_embedd)
t_c_ratio = TensionCompressionCapacityRatio(ratio_tensile_compressive_axial_capacity)
fixity = PileCapFixityRanges0PinnedTo1FixedToPileCap(pile_cap_fixity_ranges_from_0_pinned_to)
lf = FreeStandingLengthLf(free_standing_length_lf)
epaf = AxialYoungsModulusFreeStandingPartEpaf(axial_young_s_modulus_free_standing_part)
epa = AxialYoungsModulusEmbeddedPartEpa(axial_young_s_modulus_embedded_part_epa)
eplyf = LateralYZPlaneYoungsModulusFreeStandingPartEplyf(lateral_y_z_plane_young_s_modulus_free_s)
eply = LateralYZPlaneYoungsModulusEmbeddedPartEply(lateral_y_z_plane_young_s_modulus_embedd)
lf_2 = Lf(lf)
epaf_2 = Epaf(epaf)
epa_2 = Epa(epa)
eplxf_2 = Eplxf(eplxf)
eplx_2 = Eplx(eplx)
eplyf_2 = Eplyf(eplyf)
eply_2 = Eply(eply)
t_c_ratio_2 = TCRatio(t_c_ratio)
fixity_2 = Fixity(fixity)
num_5 = Number(epa_2)
num_6 = Number(eplyf_2)
num_7 = Number(lf_2)
num_8 = Number(epaf_2)
num_9 = Number(eplxf_2)
num_10 = Number(eplx_2)
num_11 = Number(eply_2)
num_12 = Number(t_c_ratio_2)
num_13 = Number(fixity_2)

filter = StreamFilter(Gate=values_2.Values, Stream1=concat_5)

graft_2 = GraftTree(Tree=filter, IncludeEmptyLists=True, IncludeNullItems=True)
file_name_s = DataDescription(simplify(graft_2))
duplicate = DuplicateDataMatch(SourceDataTree=file_name_s, SecondaryData1=file_path_2, SecondaryData2=overwrite_2, SecondaryData3=data_5)  # -> FileNameS, simplify(FilePath), Overwrite, SecondaryData3

load_case_2 = LOADCASE_2_3(tree_of_analysis=file_name_s, relay=data, i=colonna_9, C=index_of_the_1st_data_23)
load_case_2_2 = LOADCASE_2_2(tree_of_analysis=file_name_s, relay=data, i=colonna_10, C=index_of_the_1st_data_25)
load_case_2_3 = LOADCASE_2(tree_of_analysis=file_name_s, relay=data, i=colonna_11, C=index_of_the_1st_data_26)
load_case_2_4 = LOADCASE_2_2(tree_of_analysis=file_name_s, relay=data, i=colonna_12, C=index_of_the_1st_data_28)
load_case_2_5 = LOADCASE_2_2(tree_of_analysis=file_name_s, relay=data, i=colonna_14, C=index_of_the_1st_data_30)
load_case_2_6 = LOADCASE_2_2(tree_of_analysis=file_name_s, relay=data, i=colonna_15, C=index_of_the_1st_data_31)
load_case_2_7 = LOADCASE_2_3(tree_of_analysis=file_name_s, relay=data, i=colonna_16, C=index_of_the_1st_data_32)
load_case_2_8 = LOADCASE_2_4(lc_length=load_case_2_7, tree_of_analysis=file_name_s, relay=data, i=colonna_13, C=index_of_the_1st_data_29)
lcname_s = VerticalLoadVW(load_case_2_3)
lcname_s_2 = LCNameS(lcname_s)
load_type = Panel(load_case_2_8)
concat_6 = Concatenate(FragmentA=load_case_2_3, FragmentB=panel_15, FragmentC=load_type)  # disabled
load_case_name = Panel(lcname_s_2)
v_w_kn = Panel(load_case_2_2)
h_u_kn_x = Panel(load_case_2)
m_q_kn_x_to_z = Panel(load_case_2_6)
h_v_knm_y = Panel(load_case_2_5)
m_q_knm_y_to_z = Panel(load_case_2_4)
t_f_knm_x_to_y = Panel(load_case_2_7)

lng = ListLength(List=lcname_s_2)
item_19 = ListItem(List=flatten(lng), Index=0, Wrap=True)

lcname_s_3 = LCNameS(lcname_s_2)
lng_2 = ListLength(List=lcname_s_3)
int_10 = Integer(lng_2)
dup = DuplicateDataMatch(SourceDataTree=file_name_s, SecondaryData1=int_10)  # -> FileNameS, simplify(SecondaryData1)

concat_7 = Concatenate(FragmentA=title_of_analysis_from_excel, FragmentE=panel_14, FragmentD=series_8)  # -> simplify(flatten(Result))
analysis_id = Panel(series_8)
analysis_title = Panel(concat_7)
graft_3 = GraftTree(Tree=analysis_title, IncludeEmptyLists=True, IncludeNullItems=True)  # -> simplify(Tree)
graft_4 = GraftTree(Tree=analysis_id, IncludeEmptyLists=True, IncludeNullItems=True)  # -> simplify(Tree)
duplicate_data = DuplicateDataMatch(SourceDataTree=file_name_s, SecondaryData4=int_9, SecondaryData5=int_8)  # -> FileNameS, SecondaryData1, SecondaryData2, SecondaryData3, SecondaryData4, SecondaryData5

poisson_s_ratio_all_loading_modes = Panel(item_11)
axial_surface_shear_modulus_g_0 = Panel(item_16)
axial_shear_modulus_gradient_dg_dz = Panel(item_14)
axial_shear_modulus_below_base_gb = Panel(item_12)
lateral_surface_shear_modulus_g_0 = Panel(item_13)
lateral_shear_modulus_gradient_dg_dz = Panel(item_10)
soil_id = Panel(item_15)
data_6 = Data(soil_id)
num_14 = Number(poisson_s_ratio_all_loading_modes)
num_15 = Number(axial_shear_modulus_gradient_dg_dz)
num_16 = Number(lateral_surface_shear_modulus_g_0)
num_17 = Number(lateral_shear_modulus_gradient_dg_dz)
num_18 = Number(axial_surface_shear_modulus_g_0)
num_19 = Number(axial_shear_modulus_below_base_gb)
duplicate_data_2 = DuplicateDataMatch(
    SourceDataTree=file_name_s,
    SecondaryData1=data_6,
    SecondaryData2=num_14,
    SecondaryData3=num_18,
    SecondaryData4=num_15,
    SecondaryData5=num_19,
    SecondaryData6=num_16,
    SecondaryData7=num_17)  # -> FileNameS, SecondaryData1, SecondaryData2, SecondaryData3, SecondaryData4, SecondaryData5, SecondaryData6, SecondaryData7
cluster = Cluster(n_iteration=ground_iter, D=soil_id, N=piles_iter, input_if_iter_1=duplicate_data_2.SecondaryData1)
cluster_2 = Cluster(
    n_iteration=ground_iter,
    D=poisson_s_ratio_all_loading_modes,
    N=piles_iter,
    input_if_iter_1=duplicate_data_2.SecondaryData2)
cluster_3 = Cluster(
    n_iteration=ground_iter,
    D=axial_surface_shear_modulus_g_0,
    N=piles_iter,
    input_if_iter_1=duplicate_data_2.SecondaryData3)
cluster_4 = Cluster(
    n_iteration=ground_iter,
    D=axial_shear_modulus_gradient_dg_dz,
    N=piles_iter,
    input_if_iter_1=duplicate_data_2.SecondaryData4)
cluster_5 = Cluster(
    n_iteration=ground_iter,
    D=axial_shear_modulus_below_base_gb,
    N=piles_iter,
    input_if_iter_1=duplicate_data_2.SecondaryData5)
cluster_6 = Cluster(
    n_iteration=ground_iter,
    D=lateral_surface_shear_modulus_g_0,
    N=piles_iter,
    input_if_iter_1=duplicate_data_2.SecondaryData6)
cluster_7 = Cluster(
    n_iteration=ground_iter,
    D=lateral_shear_modulus_gradient_dg_dz,
    N=piles_iter,
    input_if_iter_1=duplicate_data_2.SecondaryData7)

lng_3 = ListLength(List=file_name_s_output_title_of_analysis_jso)
concat_8 = Concatenate(FragmentA="The input entered involves ", FragmentB=lng_3, FragmentC=" iterations.")
panel_16 = Panel(concat_8)
label_9 = CreateLabel(LabelText=concat_8, LabelSize="17", Justification=0)
adjustelem_7 = AdjustElementAppearance(ElementsToAdjust=label_9, Foreground=ColourSwatch(SwatchColor=RGB(52, 184, 0)))
adjustpos_9 = AdjustElementPositioning(ElementsToAdjust=label_9, Margin="0,2,0,0", AbsolutePositioning=False)

merge_3 = Merge(Data1=flatten(stack), Data2=flatten(stack_5), Data3=flatten(label_9), Data4=flatten(stack_2))
expander_2 = CreateExpander(UIElements=merge_3, Open=True)
setexp_2 = SetExpander(Expander=expander_2, Name="Set Up")

mrg_setup = Merge(Data1=flatten(expander_2), Data2=flatten(expander))
tabs = TabbedView(TabNames="Controls", TabTextSize="20", Tab0=flatten(mrg_setup))
values_6 = ValueListener(Elements=tabs, SomeProperty=True)  # -> Values, Indices
returntooldwindow = CSharpScript(windowIndex=values_6.Indices)  # -> out, newWindowIndex; inputs windowIndex: Int32
# ---------- returntooldwindow: C# ----------
    if(windowIndex >= 0){
      num = windowIndex;
    }

    newWindowIndex = num;
# ---------- returntooldwindow: C# additional code ----------
  int num = 0;
  List<int>numbers = new List<int>();
# ---------- end returntooldwindow ----------
addelems = AddElements(Window=launchwin, Elements=flatten(tabs), DoVLChecking=False)  # -> AddedElements, ElementNames
settab = SetTabbedView(TabbedView=tabs, TabNames="Controls", SetTabIndex=returntooldwindow.newWindowIndex)

concat_9 = Concatenate(
    FragmentA=title_of_analysis_from_excel,
    FragmentE="_iteration",
    FragmentD=series_8,
    FragmentB=panel_11,
    FragmentC=analysis_description)  # -> simplify(flatten(Result))

filter_2 = StreamFilter(Gate=values_2.Values, Stream1=concat_9)

python_3 = GhPythonScript(x=and_3, y=and_4, names=filter_2, new_path=panel_9, macro=temp)  # -> out, newdiagrams; inputs names: list
# ---------- python_3: Python ----------
__author__ = "Giandomenico.Azzone"
__version__ = "2024.02.21"

import rhinoscriptsyntax as rs
from shutil import copy
from datetime import datetime 

newdiagrams = []


if macro ==0:
    diag_path = 'C:/Piglet/Piglet_Diagrams.xlsx'
elif macro == 1:
    diag_path = 'C:/Piglet/Piglet_Diagrams.xlsm'

#exe_path = 'C:/Piglet/PlaceHolderForOpenPyXL.exe'
exe_path2 = 'C:/Piglet/WriteJsontoExcel.exe'
exe_path3 = 'C:/Piglet/ExportingCharts.exe'

if y == True:
    exe_destination = new_path.rsplit('\\DIAGRAMS', 1)[0]

    #copy(exe_path, exe_destination)
    copy(exe_path2, exe_destination)
    copy(exe_path3, exe_destination)


if x == True:
    
    for i in names:
        i = i.rsplit('.json', 1)[0]
        #timestamp = str(datetime.now())[:10]
        #timestamp = timestamp.replace(':', '-')
        #print(timestamp)
        
        if macro == 0:
            diag_destination = str(new_path) + '\\' + str(i) + '_Diagrams' + str('.xlsx') #+ '_' + str(timestamp) + str('.xlsx')
        
        elif macro ==1:
            diag_destination = str(new_path) + '\\' + str(i) + '_Diagrams' + str('.xlsm') #+ '_' + str(timestamp) + str('.xlsx')
        
        copy(diag_path, diag_destination)
        
        
        
        #newdiagrams.append(diag_destination)

"""
if x == True:
    
    #copy(exe_path, exe_destination)
    
    for i in names:
        #i = i.rsplit('.json', 1)[0]
        #diag_destination = str(new_path) + '\\' + str(i) + '_Diagrams' +  str('.xlsx') # + '_' + str(timestamp) + str('.xlsx')
        copy(diag_path, diag_destination)
"""
# ---------- end python_3 ----------

# ----
# PILE GROUP GEOMETRY
piles_2 = PILES_2(
    iter_of_ground=ground_iter,
    relay=data_3,
    i=colonna,
    C=index_of_the_1st_data,
    L=multiplication,
    S=index_of_the_2nd_data,
    N=gap_betw_data,
    A=piles_iter)
piles_2_2 = PILES_2(
    iter_of_ground=ground_iter,
    relay=data_3,
    i=colonna_2,
    C=index_of_the_1st_data_3,
    L=multiplication,
    S=index_of_the_2nd_data_3,
    N=gap_betw_data_3,
    A=piles_iter)
piles_2_3 = PILES_2(
    iter_of_ground=ground_iter,
    relay=data_3,
    i=colonna_3,
    C=index_of_the_1st_data_6,
    L=multiplication,
    S=index_of_the_2nd_data_6,
    N=gap_betw_data_6,
    A=piles_iter)
piles_2_4 = PILES_2(
    iter_of_ground=ground_iter,
    relay=data_3,
    i=colonna_4,
    C=index_of_the_1st_data_9,
    L=multiplication,
    S=index_of_the_2nd_data_9,
    N=gap_betw_data_9,
    A=piles_iter)
piles_2_5 = PILES_2(
    iter_of_ground=ground_iter,
    relay=data_3,
    i=colonna_5,
    C=index_of_the_1st_data_17,
    L=multiplication,
    S=index_of_the_2nd_data_17,
    N=gap_betw_data_17,
    A=piles_iter)
piles_2_6 = PILES_2(
    iter_of_ground=ground_iter,
    relay=data_3,
    i=colonna_6,
    C=index_of_the_1st_data_18,
    L=multiplication,
    S=index_of_the_2nd_data_18,
    N=gap_betw_data_18,
    A=piles_iter)
piles_2_7 = PILES_2(
    iter_of_ground=ground_iter,
    relay=data_3,
    i=colonna_7,
    C=index_of_the_1st_data_21,
    L=multiplication,
    S=index_of_the_2nd_data_21,
    N=gap_betw_data_21,
    A=piles_iter)
piles_2_8 = PILES_2(
    iter_of_ground=ground_iter,
    relay=data_3,
    i=colonna_8,
    C=index_of_the_1st_data_22,
    L=multiplication,
    S=index_of_the_2nd_data_22,
    N=gap_betw_data_22,
    A=piles_iter)
piles_profile_switches = PILES_ProfileSwitches(
    relay=data_4,
    i=riga_15,
    i_2=index_of_the_1st_data_24,
    L=multiplication,
    S=index_of_the_2nd_data_23,
    N=gap_betw_data_23,
    A=piles_iter)
piles_axial_capacity = PILES_axialCapacity(
    num_load_cases=item_19,
    L=multiplication,
    iter_of_ground=ground_iter,
    C=index_of_the_1st_data_33,
    relay=data_3,
    i=colonna_17,
    S=index_of_the_2nd_data_25,
    N=gap_betw_data_25,
    A=piles_iter)
piles_profile_switches_2 = PILES_ProfileSwitches(
    relay=data_4,
    i=riga_16,
    i_2=index_of_the_1st_data_27,
    L=multiplication,
    S=index_of_the_2nd_data_24,
    N=gap_betw_data_24,
    A=piles_iter)
shaft_diameter = Panel(piles_2_3)
x_coord = Panel(piles_2_5)
base_diameter = Panel(piles_2_6)
l_pile_embedded_length = Panel(piles_2_7)
rake_y_z_ψ_yz = Panel(piles_2_2)
y_coord = Panel(piles_2_8)
rake_x_z_ψ_xz = Panel(piles_2_4)
axial_capacity_limit = Panel(piles_axial_capacity)
numb_load_cases = Panel(dup.SecondaryData1)
num_20 = Number(shaft_diameter)
num_21 = Number(base_diameter)
num_22 = Number(l_pile_embedded_length)
num_23 = Number(y_coord)
num_24 = Number(x_coord)
num_25 = Number(rake_y_z_ψ_yz)
num_26 = Number(rake_x_z_ψ_xz)
num_27 = Number(axial_capacity_limit)
int_11 = Integer(numb_load_cases)

concat_10 = Concatenate(FragmentA=graft(panel_13), FragmentC="_ID", FragmentB=piles_2)  # -> simplify(Result)
pile_ids = Panel(concat_10)

duplicate_2 = DuplicateDataMatch(SourceDataTree=pile_ids, SecondaryData1=piles_profile_switches_2, SecondaryData2=piles_profile_switches)  # -> SourceData, SecondaryData1, SecondaryData2
profile_switches_x_z_ps_xz = Panel(duplicate_2.SecondaryData1)
profile_switches_y_z_ps_yz = Panel(duplicate_2.SecondaryData2)
int_12 = Integer(profile_switches_x_z_ps_xz)
int_13 = Integer(profile_switches_y_z_ps_yz)

piglet_file = PigletFile(NewLocation=duplicate.FilePath, NewName=file_name_s, OverWrite=duplicate.Overwrite, SaveAsExcel=duplicate.SecondaryData3)
piglet_calcdetails = PigletCalcDetails(
    AnalysisTitle=graft_3,
    AnalysisID=graft_4,
    Description=graft,
    Scope=duplicate_data.SecondaryData4,
    NoPileNodes=duplicate_data.SecondaryData5)
piglet_nlsoildetails = PigletNLSoilDetails(
    HyperbolicConstantF_a=num,
    HyperbolicPowerG_a=num_3,
    NormDispU0d50_l=num_4,
    HyperbolicPowerP_l=num_2,
    NoLoadingSteps=int_7)
piglet_piledetails = PigletPileDetails(Lf=num_7, Epf_a=num_8, Ep_a=num_5, Epf_lx=num_9, Ep_lx=num_10, Epf_ly=num_6, Ep_ly=num_11, TCRatio=num_12, Fixity=num_13)
piglet_soildetails = PigletSoilDetails(
    SoilID=cluster,
    PoissonsRatio=cluster_2,
    G0_a=cluster_3,
    DGDz_a=cluster_4,
    GB=cluster_5,
    G0_l=cluster_6,
    DGDz_l=cluster_7)
piglet_pilegroupgeometry = PigletPileGroupGeometry(
    PileIDList=pile_ids,
    XList=num_24,
    YList=num_23,
    SdList=num_20,
    BdList=num_21,
    ELList=num_22,
    RxzList=num_26,
    RyzList=num_25,
    PSxzList=int_12,
    PSyzList=int_13,
    NoLoadCases=int_11,
    AxialCapacityLimitList=num_27)
piglet_loadcases = PigletLoadCases(
    LoadCaseIDList=load_case_name,
    VList=v_w_kn,
    HxList=h_u_kn_x,
    MxzList=m_q_kn_x_to_z,
    HyList=h_v_knm_y,
    MyzList=m_q_knm_y_to_z,
    MxyList=t_f_knm_x_to_y,
    LTList=load_type)

python_4 = GhPythonScript(x=piglet_file)  # -> out, a; disabled
# ---------- python_4: Python ----------
__author__ = "Giandomenico.Azzone"
__version__ = "2024.03.01"

import rhinoscriptsyntax as rs

if x is "" or x is None:
    a = False
else:
    a = True
# ---------- end python_4 ----------

python_5 = GhPythonScript(x=piglet_file)  # -> out, a; same code as python_4
panel_17 = Panel(python_5.a)
hideshow_5 = HideShowElement(ElementToHideShow=label_9, Show=python_5.a, Collapse=True, Disable=False)

python_6 = GhPythonScript(x=piglet_file)  # -> out, a; same code as python_4
panel_18 = Panel(python_6.a)
hideshow_6 = HideShowElement(ElementToHideShow=label_7, Show=python_6.a, Collapse=True, Disable=False)

piglet_analyse = PigletAnalyse(
    PigletFile=piglet_file,
    PigletCalcDetails=piglet_calcdetails,
    PigletSoilDetails=piglet_soildetails,
    PigletSoilNLSs=piglet_nlsoildetails,
    PigletPileDetails=piglet_piledetails,
    PigletLoadCasesList=piglet_loadcases,
    PigletPileGroupGeometryList=piglet_pilegroupgeometry,
    PigletJsonVersion=int,
    Analyse=bool)
panel_19 = Panel(piglet_analyse)
filter_3 = StreamFilter(Gate=values_2.Values, Stream1=panel_19)
filter_4 = StreamFilter(Gate=values_2.Values, Stream1=filter_3)
python_7 = GhPythonScript(x=filter_4)  # -> out, a
# ---------- python_7: Python ----------
__author__ = "Giandomenico.Azzone"
__version__ = "2024.02.21"

import rhinoscriptsyntax as rs

if x == None or x == "":
    a = False
else:
    a = True
# ---------- end python_7 ----------
panel_20 = Panel(python_7.a)
item_20 = ListItem(List=flatten(python_7.a), Index=0, Wrap=True)

# ----
# earthworm output
bool_2 = Boolean(item_20)

# ----
# to run .exe file from earthworm output
and_5 = GateAnd(A=values_2.Values, B=bool_2, C=values_3.Values, D=values_4.Values)
and_6 = GateAnd(A=values_2.Values, B=bool_2, C=values_3.Values, D=values_5.Values)

# ---- group: launch 1stEXE
python_8 = GhPythonScript(x=and_5, code_repo=panel_9)  # -> out, a
# ---------- python_8: Python ----------
__author__ = "Giandomenico.Azzone"
__version__ = "2024.02.22"

import rhinoscriptsyntax as rs
import subprocess
import os
import Grasshopper
import System


#exe_file2 = exe_position + str("/ExportingCharts.exe")

#print(exe_file)

if x == True:
    
    
    exe_position = code_repo.rsplit('\\DIAGRAMS', 1)[0]
    exe_file = exe_position + str("/WriteJsontoExcel.exe")
    
    # Imposta la directory di lavoro
    os.chdir(code_repo)
    
    # Avvia il processo e attendi che termini
    process = subprocess.Popen(exe_file)
    process.wait()
    process.terminate()
    
    rs.Command("-_Grasshopper_Enter")
    Grasshopper.Instances.DocumentEditor.WindowState = System.Windows.Forms.FormWindowState.Minimized
    
    #os.chdir(code_repo)
    #process = subprocess.Popen(exe_file2)
    #process.wait()
    #rs.Command("Grasshopper")
# ---------- end python_8 ----------

# ---- group: launch 2ndEXE
python_9 = GhPythonScript(x=and_6, code_repo=panel_9)  # -> out, a
# ---------- python_9: Python ----------
__author__ = "Giandomenico.Azzone"
__version__ = "2024.02.22"

import rhinoscriptsyntax as rs
import subprocess
import os
import Grasshopper
import System




#print(exe_file)

if x == True:
    
    # Imposta la directory di lavoro
    os.chdir(code_repo)
    
    exe_position = code_repo.rsplit('\\DIAGRAMS', 1)[0]
    #exe_file = exe_position + str("/WriteJsontoExcel.exe")
    exe_file2 = exe_position + str("/ExportingCharts.exe")
    
    # Avvia il processo e attendi che termini
    #process = subprocess.Popen(exe_file)
    #process.wait()
    #rs.Command("Grasshopper")
    
    process = subprocess.Popen(exe_file2)
    process.wait()
    process.terminate()
    
    rs.Command("-_Grasshopper_Enter")
    
    Grasshopper.Instances.DocumentEditor.WindowState = System.Windows.Forms.FormWindowState.Minimized
# ---------- end python_9 ----------

# ==== cluster Cluster
N = ClusterInput()
D = ClusterInput()
input_if_iter_1 = ClusterInput()
n_iteration = ClusterInput()
dup = DuplicateData(Data=D, Number=N, Order=invert(True))
data = Data(input_if_iter_1)
larger = LargerThan(FirstNumber=n_iteration, SecondNumber="1")  # -> LargerThan, OrEqualTo
graft = GraftTree(Tree=dup, IncludeEmptyLists=True, IncludeNullItems=True)  # -> simplify(Tree)
filter = StreamFilter(Gate=larger.LargerThan, Stream0=data, Stream1=graft)
panel = Panel(filter)
s_1 = ClusterOutput(filter)

# ==== cluster PILES_1
relay = ClusterInput()
i = ClusterInput()
A = ClusterInput()
S = ClusterInput()
N = ClusterInput()
subtraction = Subtraction(A=A, B=1)
series = Series(Start=S, Step=N, Count=subtraction)
i_2 = ClusterInput()

tstat = TreeStatistics(Tree=relay)  # -> Paths, Length, Count
item = ListItem(List=tstat.Paths, Index=i, Wrap=True)
branch = TreeBranch(Tree=relay, Path=item, MaintainPaths=True)

item_2 = ListItem(List=branch, Index=series, Wrap=True)  # -> simplify(flatten(Item))
item_3 = ListItem(List=branch, Index=i_2, Wrap=True)
merge = Merge(Data1=flatten(item_3), Data2=flatten(item_2))
L = ClusterInput()
repeat = RepeatData(Data=flatten(merge), Length=L)
graft = GraftTree(Tree=repeat, IncludeEmptyLists=True, IncludeNullItems=True)  # -> simplify(Tree)
T = ClusterOutput(graft)

# ==== cluster GROUND
A = ClusterInput()
relay = ClusterInput()
i = ClusterInput()
S = ClusterInput()
N = ClusterInput()
subtraction = Subtraction(A=A, B=1)
series = Series(Start=S, Step=N, Count=subtraction)

tstat = TreeStatistics(Tree=relay)  # -> Paths, Length, Count
item = ListItem(List=tstat.Paths, Index=i, Wrap=True)
branch = TreeBranch(Tree=relay, Path=item, MaintainPaths=True)

i_2 = ClusterInput()
item_2 = ListItem(List=branch, Index=series, Wrap=True)  # -> simplify(flatten(Item))
item_3 = ListItem(List=branch, Index=i_2, Wrap=True)
merge = Merge(Data1=flatten(item_3), Data2=flatten(item_2))
L = ClusterInput()
graft = GraftTree(Tree=merge, IncludeEmptyLists=True, IncludeNullItems=True)
repeat = RepeatData(Data=flatten(merge), Length=L)  # disabled
repeat_2 = RepeatData(Data=graft, Length=L)  # -> flatten(Data)
graft_2 = GraftTree(Tree=repeat_2, IncludeEmptyLists=True, IncludeNullItems=True)  # -> simplify(Tree)
T = ClusterOutput(graft_2)
panel = Panel(graft_2)

# ==== cluster PILES_2
A = ClusterInput()
L = ClusterInput()
relay = ClusterInput()
i = ClusterInput()

tstat = TreeStatistics(Tree=relay)  # -> Paths, Length, Count
item = ListItem(List=tstat.Paths, Index=i, Wrap=True)
branch = TreeBranch(Tree=relay, Path=item, MaintainPaths=True)

iter_of_ground = ClusterInput()  # iter of ground
S = ClusterInput()
N = ClusterInput()
subtraction = Subtraction(A=A, B=1)
panel = Panel(branch)
C = ClusterInput()
series = Series(Start=0, Step=1, Count=C)
series_2 = Series(Start=S, Step=N, Count=subtraction)

tstat_2 = TreeStatistics(Tree=relay)  # -> Paths, Length, Count
item_2 = ListItem(List=tstat_2.Paths, Index=series_2, Wrap=True)
branch_2 = TreeBranch(Tree=relay, Path=item_2, MaintainPaths=True)

equals = Equality(FirstNumber=A, SecondNumber=1)  # -> Equality, Inequality
filter = StreamFilter(Gate=equals.Equality, Stream0=branch_2)
stack = StackTrees(Data0=branch, Data1=filter, Reduce=True)
cull_i = CullIndex(List=stack, Indices=series, Wrap=True)  # -> simplify(List)
panel_2 = Panel(filter)
num = Number(cull_i)
clean = CleanTree(RemoveNulls=True, RemoveInvalid=True, RemoveEmpty=invert(False), Tree=num)
len = TextLength(Text=clean)
larger = LargerThan(FirstNumber=len, SecondNumber=0)  # -> LargerThan, OrEqualTo
cull = CullPattern(List=clean, CullPattern=larger.LargerThan)
panel_4 = Panel(cull)
flatten = FlattenTree(Tree=cull, Path="{0}")
lng = ListLength(List=cull)
flatten_2 = FlattenTree(Tree=cull, Path="{0}")  # disabled
dup = DuplicateData(Data=flatten, Number=iter_of_ground, Order=True)
stack_2 = StackTrees(Data0=flatten, Data1=flatten_2, Reduce=True)  # -> flatten(Tree); disabled
repeat = RepeatData(Data=flatten(lng), Length=L)
partition = PartitionList(List=stack_2, Size=repeat)  # -> simplify(Chunks); disabled
partition_2 = PartitionList(List=dup, Size=repeat)  # -> simplify(Chunks)
C_2 = ClusterOutput(partition_2)

# ==== cluster LOADCASE_2
tree_of_analysis = ClusterInput()  # tree of analysis
relay = ClusterInput()
i = ClusterInput()
C = ClusterInput()

tstat = TreeStatistics(Tree=relay)  # -> Paths, Length, Count
item = ListItem(List=tstat.Paths, Index=i, Wrap=True)
branch = TreeBranch(Tree=relay, Path=item, MaintainPaths=True)

series = Series(Start=0, Step=1, Count=C)
cull_i = CullIndex(List=branch, Indices=series, Wrap=True)  # -> simplify(List)
txt = Text(cull_i)
txt_2 = Text(cull_i)
clean = CleanTree(RemoveNulls=True, RemoveInvalid=True, RemoveEmpty=invert(False), Tree=txt_2)
len = TextLength(Text=clean)
larger = LargerThan(FirstNumber=len, SecondNumber=0)  # -> LargerThan, OrEqualTo
cull = CullPattern(List=clean, CullPattern=larger.LargerThan)
flatten = FlattenTree(Tree=cull, Path="{0}")
panel = Panel(cull)
dup = DuplicateDataMatch(SourceDataTree=tree_of_analysis, SecondaryData1=flatten, Clean_Tree=True)  # -> FileNameS, simplify(SecondaryData1)
_1 = ClusterOutput(dup.SecondaryData1)
panel_2 = Panel(dup.SecondaryData1)

# ==== cluster LOADCASE_2_2
tree_of_analysis = ClusterInput()  # tree of analysis
relay = ClusterInput()
i = ClusterInput()
C = ClusterInput()
series = Series(Start=0, Step=1, Count=C)

tstat = TreeStatistics(Tree=relay)  # -> Paths, Length, Count
item = ListItem(List=tstat.Paths, Index=i, Wrap=True)
branch = TreeBranch(Tree=relay, Path=item, MaintainPaths=True)

cull_i = CullIndex(List=branch, Indices=series, Wrap=True)  # -> simplify(List)
num = Number(cull_i)
clean = CleanTree(RemoveNulls=True, RemoveInvalid=True, RemoveEmpty=invert(False), Tree=num)
len = TextLength(Text=clean)
larger = LargerThan(FirstNumber=len, SecondNumber=0)  # -> LargerThan, OrEqualTo
cull = CullPattern(List=clean, CullPattern=larger.LargerThan)
flatten = FlattenTree(Tree=cull, Path="{0}")
dup = DuplicateDataMatch(SourceDataTree=tree_of_analysis, SecondaryData1=flatten, Clean_Tree=True)  # -> FileNameS, simplify(SecondaryData1)
_1 = ClusterOutput(dup.SecondaryData1)
panel = Panel(dup.SecondaryData1)

# ==== cluster LOADCASE_2_3
tree_of_analysis = ClusterInput()  # tree of analysis
relay = ClusterInput()
i = ClusterInput()
C = ClusterInput()

tstat = TreeStatistics(Tree=relay)  # -> Paths, Length, Count
item = ListItem(List=tstat.Paths, Index=i, Wrap=True)
branch = TreeBranch(Tree=relay, Path=item, MaintainPaths=True)

series = Series(Start=0, Step=1, Count=C)
cull_i = CullIndex(List=branch, Indices=series, Wrap=True)  # -> simplify(List)
num = Number(cull_i)
clean = CleanTree(RemoveNulls=True, RemoveInvalid=True, RemoveEmpty=invert(False), Tree=num)
len = TextLength(Text=clean)
larger = LargerThan(FirstNumber=len, SecondNumber=0)  # -> LargerThan, OrEqualTo
cull = CullPattern(List=clean, CullPattern=larger.LargerThan)
flatten = FlattenTree(Tree=cull, Path="{0}")
dup = DuplicateDataMatch(SourceDataTree=tree_of_analysis, SecondaryData1=flatten, Clean_Tree=True)  # -> FileNameS, simplify(SecondaryData1)
_1 = ClusterOutput(dup.SecondaryData1)
panel = Panel(dup.SecondaryData1)

# ==== cluster LOADCASE_2_4
tree_of_analysis = ClusterInput()  # tree of analysis
relay = ClusterInput()
i = ClusterInput()
C = ClusterInput()
lc_length = ClusterInput()  # LC Length

tstat = TreeStatistics(Tree=lc_length)  # -> Paths, Length, Count
item = ListItem(List=tstat.Paths, Index="0", Wrap=True)
branch = TreeBranch(Tree=lc_length, Path=item, MaintainPaths=True)

series = Series(Start=0, Step=1, Count=C)

tstat_2 = TreeStatistics(Tree=relay)  # -> Paths, Length, Count
item_2 = ListItem(List=tstat_2.Paths, Index=i, Wrap=True)
branch_2 = TreeBranch(Tree=relay, Path=item_2, MaintainPaths=True)

cull_i = CullIndex(List=branch_2, Indices=series, Wrap=True)  # -> simplify(List)
num = Number(cull_i)
clean = CleanTree(RemoveNulls=True, RemoveInvalid=True, RemoveEmpty=invert(False), Tree=num)
len = TextLength(Text=clean)
larger = LargerThan(FirstNumber=len, SecondNumber=0)  # -> LargerThan, OrEqualTo
cull = CullPattern(List=clean, CullPattern=larger.LargerThan)
flatten = FlattenTree(Tree=cull, Path="{0}")
lng = ListLength(List=branch)
series_2 = Series(Start=0, Step=1, Count=lng)
item_3 = ListItem(List=flatten, Index=series_2, Wrap=True)
panel = Panel(item_3)
dup = DuplicateDataMatch(SourceDataTree=tree_of_analysis, SecondaryData1=item_3, Clean_Tree=True)  # -> FileNameS, simplify(SecondaryData1)
_1 = ClusterOutput(dup.SecondaryData1)
panel_2 = Panel(dup.SecondaryData1)

# ==== cluster PILES_axialCapacity
L = ClusterInput()
iter_of_ground = ClusterInput()  # iter of ground
C = ClusterInput()
relay = ClusterInput()
i = ClusterInput()
S = ClusterInput()
N = ClusterInput()
A = ClusterInput()
subtraction = Subtraction(A=A, B=1)
num_load_cases = ClusterInput()  # Num Load cases
series = Series(Start=0, Step=1, Count=C)
series_2 = Series(Start=S, Step=N, Count=subtraction)

tstat = TreeStatistics(Tree=relay)  # -> Paths, Length, Count
item = ListItem(List=tstat.Paths, Index=i, Wrap=True)
branch = TreeBranch(Tree=relay, Path=item, MaintainPaths=True)

tstat_2 = TreeStatistics(Tree=relay)  # -> Paths, Length, Count
item_2 = ListItem(List=tstat_2.Paths, Index=series_2, Wrap=True)
branch_2 = TreeBranch(Tree=relay, Path=item_2, MaintainPaths=True)

equals = Equality(FirstNumber=A, SecondNumber=1)  # -> Equality, Inequality
filter = StreamFilter(Gate=equals.Equality, Stream0=branch_2)
stack = StackTrees(Data0=branch, Data1=filter, Reduce=True)
cull_i = CullIndex(List=stack, Indices=series, Wrap=True)  # -> simplify(List)
int = Integer(cull_i)
clean = CleanTree(RemoveNulls=True, RemoveInvalid=True, RemoveEmpty=invert(False), Tree=int)
len = TextLength(Text=clean)
larger = LargerThan(FirstNumber=len, SecondNumber=0)  # -> LargerThan, OrEqualTo
cull = CullPattern(List=clean, CullPattern=larger.LargerThan)
panel = Panel(cull)
graft = GraftTree(Tree=cull, IncludeEmptyLists=True, IncludeNullItems=True)
repeat = RepeatData(Data=graft, Length=num_load_cases)  # -> simplify(Data)
panel_2 = Panel(repeat)
trim = TrimTree(Tree=repeat, Depth=1)
lng = ListLength(List=trim)
dup = DuplicateData(Data=flatten(trim), Number=iter_of_ground, Order=True)
repeat_2 = RepeatData(Data=flatten(lng), Length=L)
partition = PartitionList(List=dup, Size=repeat_2)  # -> simplify(Chunks)
filter_2 = StreamFilter(Gate=equals.Equality, Stream0=partition, Stream1=flatten(repeat))
s_0 = ClusterOutput(filter_2)
panel_3 = Panel(partition)

# ==== cluster PILES_ProfileSwitches
relay = ClusterInput()
i = ClusterInput()
A = ClusterInput()

tstat = TreeStatistics(Tree=relay)  # -> Paths, Length, Count
item = ListItem(List=tstat.Paths, Index=i, Wrap=True)
branch = TreeBranch(Tree=relay, Path=item, MaintainPaths=True)

panel = Panel("20")
S = ClusterInput()
N = ClusterInput()
subtraction = Subtraction(A=A, B=1)
series = Series(Start=S, Step=N, Count=subtraction)
i_2 = ClusterInput()
item_2 = ListItem(List=branch, Index=series, Wrap=True)  # -> simplify(flatten(Item))
item_3 = ListItem(List=branch, Index=i_2, Wrap=True)
merge = Merge(Data1=flatten(item_3), Data2=flatten(item_2))
panel_2 = Panel(branch)
L = ClusterInput()
repeat = RepeatData(Data=flatten(merge), Length=L)
graft = GraftTree(Tree=repeat, IncludeEmptyLists=True, IncludeNullItems=True)  # -> simplify(Tree)
T = ClusterOutput(graft)
