# Grasshopper definition PIGRO_Script.gh (Grasshopper 1.0.7)
# Copyright: Arup
# plug-ins: HFTidyCanvas, EarthwormGrasshopper, EleFront, PancakeSpreadsheet

to_open_args_dir = GhPythonScript()  # -> out, script_path, input_path
# ---------- to_open_args_dir: Python ----------
__author__ = "Giandomenico.Azzone"
__version__ = "2024.02.21"

import os
import os.path as op
import scriptcontext as sc
import Rhino
import Grasshopper as gh

gh_path = gh.Instances.DocumentServer[0].FilePath

script_path = gh_path


if gh_path:
    script_folder = op.dirname(gh_path)

    for file in os.listdir(script_folder):
        if file.endswith("input_path.txt"):
            input_path = op.join(script_folder, file)
            print("File trovato:", input_path)
            break
    else:
        input_path = ""
        print("Nessun file input_path.txt con 'pigro_input' trovato")
else:
    pass
script_path = gh_path
# ---------- end to_open_args_dir ----------
file = ReadFile(File=to_open_args_dir.input_path, PerLineParse=True)
panel = Panel(file)
item = ListItem(List=panel, Index=0, Wrap=invert(True))  # -> Item, Item1
to_open_excel_input = GhPythonScript(folder=item.Item)  # -> out, script_path, excel_path; disabled
# ---------- to_open_excel_input: Python ----------
__author__ = "Giandomenico.Azzone"
__version__ = "2024.02.21"
"""

import os
import os.path as op
import scriptcontext as sc
import Rhino
import Grasshopper as gh

gh_path = gh.Instances.DocumentServer[0].FilePath

script_path = gh_path

if gh_path:
    script_folder = op.dirname(gh_path)

    for file in os.listdir(script_folder):
        if file.endswith("pigro_input.xlsx"):
            excel_path = op.join(script_folder, file)
            print("File trovato:", excel_path)
            break
    else:
        excel_path = ""
        print("Nessun file .xlsx con 'pigro_input' trovato")
else:
    print("Il documento Grasshopper non è stato salvato.")
script_path = gh_path
"""

import os

def find_excel_file(folder):
    # Costruisce il percorso della cartella "input"
    input_folder = os.path.join(folder, "input")
    print(input_folder)
    
    # Verifica se la cartella "input" esiste
    if not os.path.isdir(input_folder):
        return None
    
    # Cerca il file Excel che termina con "_pigro_input.xlsx"
    for filename in os.listdir(input_folder):
        if filename.endswith("pigro_input.xlsx"):
            return os.path.join(input_folder, filename)
    
    return None

# Input per Grasshopper
excel_path = find_excel_file(folder)
# ---------- end to_open_excel_input ----------
number_of_pile_discretization_nodes_or_n = Panel("32")  # "Number of pile discretization nodes - or - Number of nodes in the pile node results"

test_ground_iterat_simulation = ValueList({"1", "2", "3", "4"}, selected="3")  # disabled
test_piles_iterat_simulation = ValueList({"1", "2", "3", "4", "10"}, selected="3")  # disabled

colonna = Panel("3")
index_of_the_1st_data = Panel("8")
index_of_the_2nd_data = Panel("19")
gap_betw_data = Panel("14")

riga = Panel("19")
index_of_the_1st_data_2 = Panel("16")
index_of_the_2nd_data_2 = Panel("30")
gap_betw_data_2 = Panel("14")

colonna_2 = Panel("11")
index_of_the_1st_data_3 = Panel("8")
index_of_the_2nd_data_3 = Panel("27")
gap_betw_data_3 = Panel("14")

riga_2 = Panel("17")
index_of_the_2nd_data_4 = Panel("30")
index_of_the_1st_data_4 = Panel("16")
gap_betw_data_4 = Panel("14")

riga_3 = Panel("18")
index_of_the_2nd_data_5 = Panel("30")
index_of_the_1st_data_5 = Panel("16")
gap_betw_data_5 = Panel("14")

colonna_3 = Panel("4")
index_of_the_1st_data_6 = Panel("8")
index_of_the_2nd_data_6 = Panel("20")
gap_betw_data_6 = Panel("14")

riga_4 = Panel("16")
index_of_the_2nd_data_7 = Panel("30")
index_of_the_1st_data_7 = Panel("16")
gap_betw_data_7 = Panel("14")

riga_5 = Panel("15")
index_of_the_2nd_data_8 = Panel("30")
index_of_the_1st_data_8 = Panel("16")
gap_betw_data_8 = Panel("14")

colonna_4 = Panel("10")
index_of_the_1st_data_9 = Panel("8")
index_of_the_2nd_data_9 = Panel("26")
gap_betw_data_9 = Panel("14")

riga_6 = Panel("7")
index_of_the_2nd_data_10 = Panel("30")
index_of_the_1st_data_10 = Panel("16")
gap_betw_data_10 = Panel("14")

index_of_the_1st_data_11 = Panel("16")
gap_betw_data_11 = Panel("14")
riga_7 = Panel("8")
index_of_the_2nd_data_11 = Panel("30")

riga_8 = Panel("9")
index_of_the_2nd_data_12 = Panel("30")
index_of_the_1st_data_12 = Panel("16")
gap_betw_data_12 = Panel("14")

riga_9 = Panel("10")
index_of_the_1st_data_13 = Panel("16")
index_of_the_2nd_data_13 = Panel("30")
gap_betw_data_13 = Panel("14")

index_of_the_1st_data_14 = Panel("16")
riga_10 = Panel("11")
index_of_the_2nd_data_14 = Panel("30")
gap_betw_data_14 = Panel("14")

riga_11 = Panel("12")
index_of_the_2nd_data_15 = Panel("30")
gap_betw_data_15 = Panel("14")
index_of_the_1st_data_15 = Panel("16")

riga_12 = Panel("6")
index_of_the_1st_data_16 = Panel("16")
index_of_the_2nd_data_16 = Panel("30")
gap_betw_data_16 = Panel("14")

colonna_5 = Panel("6")
index_of_the_1st_data_17 = Panel("8")
index_of_the_2nd_data_17 = Panel("22")
gap_betw_data_17 = Panel("14")

colonna_6 = Panel("5")
index_of_the_1st_data_18 = Panel("8")
index_of_the_2nd_data_18 = Panel("21")
gap_betw_data_18 = Panel("14")

riga_13 = Panel("4")
index_of_the_1st_data_19 = Panel("4")
index_of_the_2nd_data_19 = Panel("20")
gap_betw_data_19 = Panel("14")

riga_14 = Panel("13")
index_of_the_1st_data_20 = Panel("16")
index_of_the_2nd_data_20 = Panel("30")
gap_betw_data_20 = Panel("14")

colonna_7 = Panel("9")
index_of_the_1st_data_21 = Panel("8")
index_of_the_2nd_data_21 = Panel("25")
gap_betw_data_21 = Panel("14")

colonna_8 = Panel("7")
index_of_the_1st_data_22 = Panel("8")
index_of_the_2nd_data_22 = Panel("23")
gap_betw_data_22 = Panel("14")

riga_15 = Panel("21")
index_of_the_1st_data_23 = Panel("16")
index_of_the_2nd_data_23 = Panel("30")
gap_betw_data_23 = Panel("14")

riga_16 = Panel("20")
index_of_the_1st_data_24 = Panel("16")
index_of_the_2nd_data_24 = Panel("30")
gap_betw_data_24 = Panel("14")

# ----
# Load Types: -1: non-linear analysis, inputs are loads
#  1: rigid pile-cap, inputs are loads
#  2: rigid pile-cap, inputs are deflections
#  3: flexible pile-cap, inputs are loads
#  4: flexible pile-cap, inputs are deflections
index_of_the_1st_data_25 = Panel("11")
# Load Case Names: LC A
# LC B
# LC C
# LC D
# LC E
# LC F
# LC A
# LC B
# LC C
# LC D
# LC E
# LC F
riga_17 = Panel("36")
index_of_the_2nd_data_25 = Panel("20")
gap_betw_data_25 = Panel("14")

index_of_the_1st_data_26 = Panel("11")
riga_18 = Panel("37")

index_of_the_1st_data_27 = Panel("11")
riga_19 = Panel("38")

index_of_the_1st_data_28 = Panel("11")
riga_20 = Panel("39")

index_of_the_1st_data_29 = Panel("11")
riga_21 = Panel("40")

index_of_the_1st_data_30 = Panel("11")
riga_22 = Panel("41")

index_of_the_1st_data_31 = Panel("11")
riga_23 = Panel("42")

index_of_the_1st_data_32 = Panel("11")
riga_24 = Panel("43")

piglet_json_version_always_1 = ValueList({"0", "1"}, selected="1")
int = Integer(piglet_json_version_always_1)

to_open_excel_input_2 = GhPythonScript(folder=item.Item)  # -> out, script_path, excel_path
# ---------- to_open_excel_input_2: Python ----------
__author__ = "Giandomenico.Azzone"
__version__ = "2024.02.21"


import os

def find_excel_file(folder):
    input_folder = folder #os.path.join(folder, "input")
    
    
    # Verifica se la cartella "input" esiste
    if not os.path.isdir(input_folder):
        return None
    
    # Cerca il file Excel che termina con "_pigro_input.xlsx"
    for filename in os.listdir(input_folder):
        if filename.endswith("pigro_input.xlsx"):
            return os.path.join(input_folder, filename)
    
    return None

# Input per Grasshopper
excel_path = find_excel_file(folder)
# ---------- end to_open_excel_input_2 ----------
to_read_excel_input = GhPythonScript(x=to_open_excel_input_2.excel_path)  # -> out, a
# ---------- to_read_excel_input: Python ----------
__author__ = "Giandomenico.Azzone"
__version__ = "2025.03.08"

"""
import rhinoscriptsyntax as rs
from shutil import copy
from datetime import datetime 

import os.path as op


#print genv.LocalScope.ghdoc.Path
print ghdoc.Path
print op.basename(ghdoc.Path)
"""
import os
import os.path as op
import scriptcontext as sc
import Rhino
import Grasshopper as gh
if x != None and x != "":
    a = True
else:
    a = False
# ---------- end to_read_excel_input ----------
input_piglet_excel_file = Panel(to_open_excel_input_2.excel_path)

int_2 = Integer("4")
int_3 = Integer("2")
int_4 = Integer("3")
int_5 = Integer("3")
int_6 = Integer("1")
pssimpleread = SimpleReadXLSX(File=to_open_excel_input_2.excel_path, SheetIdentifier=int_3, RowFirst=invert(True), OK=to_read_excel_input.a)
pssimpleread_2 = SimpleReadXLSX(File=to_open_excel_input_2.excel_path, SheetIdentifier=int_4, RowFirst=invert(True), OK=to_read_excel_input.a)
pssimpleread_3 = SimpleReadXLSX(File=to_open_excel_input_2.excel_path, SheetIdentifier=int_5, RowFirst=True, OK=to_read_excel_input.a)
pssimpleread_4 = SimpleReadXLSX(File=to_open_excel_input_2.excel_path, SheetIdentifier=int_2, RowFirst=invert(True), OK=to_read_excel_input.a)
panel_3 = Panel(pssimpleread_3)
pssimpleread_5 = SimpleReadXLSX(File=to_open_excel_input_2.excel_path, SheetIdentifier=int_6, RowFirst=invert(True), OK=to_read_excel_input.a)
panel_4 = Panel(pssimpleread)
panel_5 = Panel(pssimpleread_5)
data = Data(pssimpleread_4)
data_2 = Data(pssimpleread_5)

data_3 = Data(pssimpleread_2)
data_4 = Data(pssimpleread_3)

# ----
# automatic creation of folder for output
python = GhPythonScript(x=to_open_excel_input_2.excel_path, y=to_read_excel_input.a)  # -> out, a
# ---------- python: Python ----------
__author__ = "Giandomenico.Azzone"
__version__ = "2023.12.22"

import rhinoscriptsyntax as rs
if x != None and y ==True: # or x is not;"": 
    a = True
    """
elif x != "":
    a = True
    """
else:
    a = False
print(x)
print(a)
# ---------- end python ----------
panel_6 = Panel(python.a)

overwrite = BooleanToggle(True)
always_false = BooleanToggle(False)
data_5 = Data(always_false)
overwrite_2 = BooleanToggle(overwrite)

tstat = TreeStatistics(Tree=pssimpleread)  # -> Paths, Length, Count
item_2 = ListItem(List=tstat.Paths, Index="1", Wrap=True)
branch = TreeBranch(Tree=pssimpleread, Path=item_2, MaintainPaths=True)

tstat_2 = TreeStatistics(Tree=data_3)  # -> Paths, Length, Count
item_3 = ListItem(List=tstat_2.Paths, Index="1", Wrap=True)
branch_2 = TreeBranch(Tree=data_3, Path=item_3, MaintainPaths=True)

tstat_3 = TreeStatistics(Tree=data_2)  # -> Paths, Length, Count
item_4 = ListItem(List=tstat_3.Paths, Index="1", Wrap=True)
branch_3 = TreeBranch(Tree=data_2, Path=item_4, MaintainPaths=True)

# ----
# Automatic Output file path
panel_7 = Panel("PIGRO_Output")

concat = Concatenate(FragmentA=item.Item1, FragmentE="\", FragmentB=panel_7)

file_path = Panel(concat)

colonna_9 = Panel("8")
index_of_the_1st_data_33 = Panel("8")
index_of_the_2nd_data_33 = Panel("24")
gap_betw_data_33 = Panel("14")

# ----
# Ground_characterisation
panel_8 = Panel("4")

tstat_4 = TreeStatistics(Tree=pssimpleread)  # -> Paths, Length, Count
item_5 = ListItem(List=tstat_4.Paths, Index=panel_8, Wrap=True)
branch_4 = TreeBranch(Tree=pssimpleread, Path=item_5, MaintainPaths=True)

tstat_5 = TreeStatistics(Tree=pssimpleread)  # -> Paths, Length, Count
item_6 = ListItem(List=tstat_5.Paths, Index="3", Wrap=True)
branch_5 = TreeBranch(Tree=pssimpleread, Path=item_6, MaintainPaths=True)

item_7 = ListItem(List=branch_3, Index=0, Wrap=True)
item_8 = ListItem(List=branch, Index=0, Wrap=True)
item_9 = ListItem(List=branch_2, Index=0, Wrap=True)
iteration_of_piles_from_excel = Panel(item_9)
title_of_analysis_from_excel = Panel(item_7)
iteration_of_ground_from_excel = Panel(item_8)

ground_iter = Integer(iteration_of_ground_from_excel)
piles_iter = Integer(iteration_of_piles_from_excel)

ground_series = Series(Start=1, Step=1, Count=ground_iter)  # -> graft(Series)
pile_series = Series(Start=1, Step=1, Count=piles_iter)
concat_2 = Concatenate(FragmentA="GroundOpt", FragmentB=ground_series, FragmentC="_PilesOpt", FragmentD=pile_series)  # -> simplify(Result)
flatten = FlattenTree(Tree=concat_2, Path="{0}")

split = TextSplit(Text=flatten, Separators="_")
item_10 = ListItem(List=reverse(split), Index=0, Wrap=True)  # -> flatten(Item)

# ----
# SOIL DATA NON LINEAR
ground = GROUND(
    relay=data_4,
    i=riga_5,
    i_2=index_of_the_1st_data_8,
    L=piles_iter,
    S=index_of_the_2nd_data_8,
    N=gap_betw_data_8,
    A=ground_iter)
ground_2 = GROUND(
    relay=data_4,
    i=riga_4,
    i_2=index_of_the_1st_data_7,
    L=piles_iter,
    S=index_of_the_2nd_data_7,
    N=gap_betw_data_7,
    A=ground_iter)
ground_3 = GROUND(
    relay=data_4,
    i=riga_2,
    i_2=index_of_the_1st_data_4,
    L=piles_iter,
    S=index_of_the_2nd_data_4,
    N=gap_betw_data_4,
    A=ground_iter)
ground_4 = GROUND(
    relay=data_4,
    i=riga_3,
    i_2=index_of_the_1st_data_5,
    L=piles_iter,
    S=index_of_the_2nd_data_5,
    N=gap_betw_data_5,
    A=ground_iter)
ground_5 = GROUND(
    relay=data_4,
    i=riga,
    i_2=index_of_the_1st_data_2,
    L=piles_iter,
    S=index_of_the_2nd_data_2,
    N=gap_betw_data_2,
    A=ground_iter)
lateral_normalised_disp_to_halve_stiffne = Panel(ground_3)  # "Lateral: Normalised disp. to halve stiffness, (u0/d)50"
axial_hyperbolic_power_g = Panel(ground_2)
lateral_hyperbolic_power_p = Panel(ground_4)
number_of_load_steps = Panel(ground_5)
axial_hyperbolic_constant_f = Panel(ground)
f = AxialHyperbolicConstantF(axial_hyperbolic_constant_f)
g = AxialHyperbolicPowerG(axial_hyperbolic_power_g)
u0_d_50 = LateralNormalisedDispToHalveStiffnessU0D50(lateral_normalised_disp_to_halve_stiffne)
p = LateralHyperbolicPowerG(lateral_hyperbolic_power_p)
inc = NumberOfLoadSteps(number_of_load_steps)
f_2 = F(f)
g_2 = G(g)
u0_d_50_2 = U0D50(u0_d_50)
p_2 = P(p)
inc_2 = Inc(inc)
f_3 = F(f_2)
g_3 = G(g_2)
u0_d_50_3 = U0D50(u0_d_50_2)
p_3 = P(p_2)
inc_3 = Inc(inc_2)

panel_9 = Panel(item_10)
load_case_new = LOAD_CASE_New(relay=data, i=riga_17, C=index_of_the_1st_data_25, no_piles_iterat=piles_iter)
load_case_new_2 = LOAD_CASE_New_2(relay=data, i=riga_18, C=index_of_the_1st_data_26, no_piles_iterat=piles_iter)
load_case_new_3 = LOAD_CASE_New_3(relay=data, i=riga_19, C=index_of_the_1st_data_27, no_piles_iterat=piles_iter)
load_case_new_4 = LOAD_CASE_New_4(relay=data, i=riga_20, C=index_of_the_1st_data_28, no_piles_iterat=piles_iter)
load_case_new_5 = LOAD_CASE_New_5(relay=data, i=riga_21, C=index_of_the_1st_data_29, no_piles_iterat=piles_iter)
load_case_new_6 = LOAD_CASE_New_6(relay=data, i=riga_22, C=index_of_the_1st_data_30, no_piles_iterat=piles_iter)
load_case_new_7 = LOAD_CASE_New_7(relay=data, i=riga_23, C=index_of_the_1st_data_31, no_piles_iterat=piles_iter)
load_case_new_8 = LOAD_CASE_New_8(relay=data, i=riga_24, C=index_of_the_1st_data_32, no_piles_iterat=piles_iter)

index_of_the_data = Panel("6")
gap_betw_data_34 = Panel("9")
series = Series(Start=index_of_the_data, Step=gap_betw_data_34, Count=ground_iter)
item_11 = ListItem(List=branch_4, Index=series, Wrap=True)  # -> simplify(flatten(Item))

index_of_the_data_2 = Panel("7")
gap_betw_data_35 = Panel("9")
series_2 = Series(Start=index_of_the_data_2, Step=gap_betw_data_35, Count=ground_iter)
item_12 = ListItem(List=branch_4, Index=series_2, Wrap=True)  # -> simplify(flatten(Item))

index_of_the_data_3 = Panel("4")
gap_betw_data_36 = Panel("9")
series_3 = Series(Start=index_of_the_data_3, Step=gap_betw_data_36, Count=ground_iter)
item_13 = ListItem(List=branch_4, Index=series_3, Wrap=True)  # -> simplify(flatten(Item))

index_of_the_data_4 = Panel("5")
gap_betw_data_37 = Panel("9")
series_4 = Series(Start=index_of_the_data_4, Step=gap_betw_data_37, Count=ground_iter)
item_14 = ListItem(List=branch_4, Index=series_4, Wrap=True)  # -> simplify(flatten(Item))

index_of_the_data_5 = Panel("3")
gap_betw_data_38 = Panel("9")
series_5 = Series(Start=index_of_the_data_5, Step=gap_betw_data_38, Count=ground_iter)
item_15 = ListItem(List=branch_4, Index=series_5, Wrap=True)  # -> simplify(flatten(Item))

index_of_the_data_6 = Panel("1")
gap_betw_data_39 = Panel("9")
series_6 = Series(Start=index_of_the_data_6, Step=gap_betw_data_39, Count=ground_iter)
item_16 = ListItem(List=branch_5, Index=series_6, Wrap=True)  # -> simplify(flatten(Item))

index_of_the_data_7 = Panel("2")
gap_betw_data_40 = Panel("9")
series_7 = Series(Start=index_of_the_data_7, Step=gap_betw_data_40, Count=ground_iter)
item_17 = ListItem(List=branch_4, Index=series_7, Wrap=True)  # -> simplify(flatten(Item))

# ----
# LOAD CASES
lcname_s = VerticalLoadVW(load_case_new)
lcname_s_2 = LCNameS(lcname_s)
load_type = Panel(load_case_new_8)
load_case_name = Panel(lcname_s_2)
v_w_kn = Panel(load_case_new_2)
h_u_kn_x = Panel(load_case_new_3)
m_q_kn_x_to_z = Panel(load_case_new_4)
h_v_knm_y = Panel(load_case_new_5)
m_q_knm_y_to_z = Panel(load_case_new_6)
t_f_knm_x_to_y = Panel(load_case_new_7)

lng = ListLength(List=lcname_s_2)

ground_series_2 = Series(Start=1, Step=1, Count=ground_iter)  # -> graft(Series)
pile_series_2 = Series(Start=1, Step=1, Count=piles_iter)
concat_3 = Concatenate(FragmentA="G", FragmentB=ground_series_2, FragmentC="_P", FragmentD=pile_series_2)  # -> simplify(Result)
flatten_2 = FlattenTree(Tree=concat_3, Path="{0}")

num = Number(f_3)
num_2 = Number(p_3)
num_3 = Number(g_3)
num_4 = Number(u0_d_50_3)
int_7 = Integer(inc_3)

lcname_s_3 = LCNameS(lcname_s_2)
lng_2 = ListLength(List=lcname_s_3)
int_8 = Integer(lng_2)

panel_10 = Panel(int_8)

tstat_6 = TreeStatistics(Tree=data_2)  # -> Paths, Length, Count

# ----
# DESCRIPTION AND SCOPE
panel_11 = Panel("_iteration")
analysis_description = Panel(flatten)
int_9 = Integer(number_of_pile_discretization_nodes_or_n)
graft = GraftTree(Tree=analysis_description, IncludeEmptyLists=True, IncludeNullItems=True)  # -> simplify(Tree)

item_18 = ListItem(List=tstat_6.Paths, Index="1", Wrap=True)
branch_6 = TreeBranch(Tree=data_2, Path=item_18, MaintainPaths=True)

item_19 = ListItem(List=branch_6, Index=2, Wrap=True)  # -> simplify(flatten(Item))
scope_1_vertical_loading_2_x_z_plane_3_6 = Panel(item_19)  # "Scope: (1) vertical loading, (2) x:z plane, (3) 6 degrees of freedom"
int_10 = Integer(scope_1_vertical_loading_2_x_z_plane_3_6)

# ----
# PILE GROUP GEOMETRY
numb_load_cases = Panel(int_8)
int_11 = Integer(numb_load_cases)

multiplication = Multiplication(A=ground_iter, B=piles_iter)
series_8 = Series(Start=1, Step=1, Count=multiplication)
concat_4 = Concatenate(FragmentA=title_of_analysis_from_excel, FragmentE="_iteration", FragmentD=series_8, FragmentB=".json")  # -> simplify(flatten(Result))
file_name_s_output_title_of_analysis_jso = Panel(concat_4)  # "File name(s) output - Title of analysis .json for eathworm"

# ----
# PILE DATA
piles_1 = PILES_1(
    relay=data_4,
    i=riga_12,
    i_2=index_of_the_1st_data_16,
    L=multiplication,
    S=index_of_the_2nd_data_16,
    N=gap_betw_data_16,
    A=piles_iter)
piles_1_2 = PILES_1(
    relay=data_4,
    i=riga_14,
    i_2=index_of_the_1st_data_20,
    L=multiplication,
    S=index_of_the_2nd_data_20,
    N=gap_betw_data_20,
    A=piles_iter)
piles_1_3 = PILES_1(
    relay=data_4,
    i=riga_13,
    i_2=index_of_the_1st_data_19,
    L=multiplication,
    S=index_of_the_2nd_data_19,
    N=gap_betw_data_19,
    A=piles_iter)
piles_1_4 = PILES_1(
    relay=data_4,
    i=riga_6,
    i_2=index_of_the_1st_data_10,
    L=multiplication,
    S=index_of_the_2nd_data_10,
    N=gap_betw_data_10,
    A=piles_iter)
piles_1_5 = PILES_1(
    relay=data_4,
    i=riga_7,
    i_2=index_of_the_1st_data_11,
    L=multiplication,
    S=index_of_the_2nd_data_11,
    N=gap_betw_data_11,
    A=piles_iter)
piles_1_6 = PILES_1(
    relay=data_4,
    i=riga_8,
    i_2=index_of_the_1st_data_12,
    L=multiplication,
    S=index_of_the_2nd_data_12,
    N=gap_betw_data_12,
    A=piles_iter)
piles_1_7 = PILES_1(
    relay=data_4,
    i=riga_9,
    i_2=index_of_the_1st_data_13,
    L=multiplication,
    S=index_of_the_2nd_data_13,
    N=gap_betw_data_13,
    A=piles_iter)
piles_1_8 = PILES_1(
    relay=data_4,
    i=riga_10,
    i_2=index_of_the_1st_data_14,
    L=multiplication,
    S=index_of_the_2nd_data_14,
    N=gap_betw_data_14,
    A=piles_iter)
piles_1_9 = PILES_1(
    relay=data_4,
    i=riga_11,
    i_2=index_of_the_1st_data_15,
    L=multiplication,
    S=index_of_the_2nd_data_15,
    N=gap_betw_data_15,
    A=piles_iter)
free_standing_length_lf = Panel(piles_1)
axial_young_s_modulus_free_standing_part = Panel(piles_1_4)  # "Axial: Young's modulus free-standing part, Epaf"
axial_young_s_modulus_embedded_part_epa = Panel(piles_1_5)
lateral_x_z_plane_young_s_modulus_free_s = Panel(piles_1_6)  # "Lateral (x-z plane): Young's modulus free-standing part, Eplxf"
lateral_y_z_plane_young_s_modulus_free_s = Panel(piles_1_8)  # "Lateral (y-z plane): Young's modulus free-standing part, Eplyf"
lateral_y_z_plane_young_s_modulus_embedd = Panel(piles_1_9)  # "Lateral (y-z plane): Young's modulus: embedded part, Eply"
ratio_tensile_compressive_axial_capacity = Panel(piles_1_3)
lateral_x_z_plane_young_s_modulus_embedd = Panel(piles_1_7)  # "Lateral (x-z plane): Young's modulus: embedded part, Eplx"
pile_cap_fixity_ranges_from_0_pinned_to = Panel(piles_1_2)  # "Pile cap fixity: ranges from 0 (pinned) to 1 (fixed to pile-cap)"
eplxf = LateralXZPlaneYoungsModulusFreeStandingPartEplxf(lateral_x_z_plane_young_s_modulus_free_s)
eplx = LateralXZPlaneYoungsModulusEmbeddedPartEplx(lateral_x_z_plane_young_s_modulus_embedd)
t_c_ratio = TensionCompressionCapacityRatio(ratio_tensile_compressive_axial_capacity)
fixity = PileCapFixityRanges0PinnedTo1FixedToPileCap(pile_cap_fixity_ranges_from_0_pinned_to)
lf = FreeStandingLengthLf(free_standing_length_lf)
epaf = AxialYoungsModulusFreeStandingPartEpaf(axial_young_s_modulus_free_standing_part)
epa = AxialYoungsModulusEmbeddedPartEpa(axial_young_s_modulus_embedded_part_epa)
eplyf = LateralYZPlaneYoungsModulusFreeStandingPartEplyf(lateral_y_z_plane_young_s_modulus_free_s)
eply = LateralYZPlaneYoungsModulusEmbeddedPartEply(lateral_y_z_plane_young_s_modulus_embedd)
lf_2 = Lf(lf)
epaf_2 = Epaf(epaf)
epa_2 = Epa(epa)
eplxf_2 = Eplxf(eplxf)
eplx_2 = Eplx(eplx)
eplyf_2 = Eplyf(eplyf)
eply_2 = Eply(eply)
t_c_ratio_2 = TCRatio(t_c_ratio)
fixity_2 = Fixity(fixity)
num_5 = Number(epa_2)
num_6 = Number(eplyf_2)
num_7 = Number(lf_2)
num_8 = Number(epaf_2)
num_9 = Number(eplxf_2)
num_10 = Number(eplx_2)
num_11 = Number(eply_2)
num_12 = Number(t_c_ratio_2)
num_13 = Number(fixity_2)

filter = StreamFilter(Gate=to_read_excel_input.a, Stream1=concat_4)

piles_2 = PILES_2(
    iter_of_ground=ground_iter,
    relay=data_3,
    i=colonna,
    C=index_of_the_1st_data,
    L=multiplication,
    S=index_of_the_2nd_data,
    N=gap_betw_data,
    A=piles_iter)
piles_2_2 = PILES_2(
    iter_of_ground=ground_iter,
    relay=data_3,
    i=colonna_2,
    C=index_of_the_1st_data_3,
    L=multiplication,
    S=index_of_the_2nd_data_3,
    N=gap_betw_data_3,
    A=piles_iter)
piles_2_3 = PILES_2(
    iter_of_ground=ground_iter,
    relay=data_3,
    i=colonna_3,
    C=index_of_the_1st_data_6,
    L=multiplication,
    S=index_of_the_2nd_data_6,
    N=gap_betw_data_6,
    A=piles_iter)
piles_2_4 = PILES_2(
    iter_of_ground=ground_iter,
    relay=data_3,
    i=colonna_4,
    C=index_of_the_1st_data_9,
    L=multiplication,
    S=index_of_the_2nd_data_9,
    N=gap_betw_data_9,
    A=piles_iter)
piles_2_5 = PILES_2(
    iter_of_ground=ground_iter,
    relay=data_3,
    i=colonna_5,
    C=index_of_the_1st_data_17,
    L=multiplication,
    S=index_of_the_2nd_data_17,
    N=gap_betw_data_17,
    A=piles_iter)
piles_2_6 = PILES_2(
    iter_of_ground=ground_iter,
    relay=data_3,
    i=colonna_6,
    C=index_of_the_1st_data_18,
    L=multiplication,
    S=index_of_the_2nd_data_18,
    N=gap_betw_data_18,
    A=piles_iter)
piles_2_7 = PILES_2(
    iter_of_ground=ground_iter,
    relay=data_3,
    i=colonna_7,
    C=index_of_the_1st_data_21,
    L=multiplication,
    S=index_of_the_2nd_data_21,
    N=gap_betw_data_21,
    A=piles_iter)
piles_2_8 = PILES_2(
    iter_of_ground=ground_iter,
    relay=data_3,
    i=colonna_8,
    C=index_of_the_1st_data_22,
    L=multiplication,
    S=index_of_the_2nd_data_22,
    N=gap_betw_data_22,
    A=piles_iter)
piles_profile_switches = PILES_ProfileSwitches(
    relay=data_4,
    i=riga_15,
    i_2=index_of_the_1st_data_23,
    L=multiplication,
    S=index_of_the_2nd_data_23,
    N=gap_betw_data_23,
    A=piles_iter)
piles_axial_capacity = PILES_axialCapacity(
    num_load_cases=lng,
    L=multiplication,
    iter_of_ground=ground_iter,
    C=index_of_the_1st_data_33,
    relay=data_3,
    i=colonna_9,
    S=index_of_the_2nd_data_33,
    N=gap_betw_data_33,
    A=piles_iter)
piles_profile_switches_2 = PILES_ProfileSwitches(
    relay=data_4,
    i=riga_16,
    i_2=index_of_the_1st_data_24,
    L=multiplication,
    S=index_of_the_2nd_data_24,
    N=gap_betw_data_24,
    A=piles_iter)
shaft_diameter = Panel(piles_2_3)
x_coord = Panel(piles_2_5)
base_diameter = Panel(piles_2_6)
l_pile_embedded_length = Panel(piles_2_7)
rake_y_z_ψ_yz = Panel(piles_2_2)
y_coord = Panel(piles_2_8)
rake_x_z_ψ_xz = Panel(piles_2_4)
axial_capacity_limit = Panel(piles_axial_capacity)
num_14 = Number(shaft_diameter)
num_15 = Number(base_diameter)
num_16 = Number(l_pile_embedded_length)
num_17 = Number(y_coord)
num_18 = Number(x_coord)
num_19 = Number(rake_y_z_ψ_yz)
num_20 = Number(rake_x_z_ψ_xz)
num_21 = Number(axial_capacity_limit)

concat_5 = Concatenate(FragmentA=graft(panel_9), FragmentC="_ID", FragmentB=piles_2)  # -> simplify(Result)
pile_ids = Panel(concat_5)

duplicate = DuplicateDataMatch(SourceDataTree=pile_ids, SecondaryData1=piles_profile_switches_2, SecondaryData2=piles_profile_switches)  # -> SourceData, SecondaryData1, SecondaryData2
profile_switches_x_z_ps_xz = Panel(duplicate.SecondaryData1)
profile_switches_y_z_ps_yz = Panel(duplicate.SecondaryData2)
int_12 = Integer(profile_switches_x_z_ps_xz)
int_13 = Integer(profile_switches_y_z_ps_yz)

concat_6 = Concatenate(FragmentA=title_of_analysis_from_excel, FragmentE=panel_11, FragmentD=series_8)  # -> simplify(flatten(Result))
analysis_id = Panel(series_8)
analysis_title = Panel(concat_6)
graft_2 = GraftTree(Tree=analysis_title, IncludeEmptyLists=True, IncludeNullItems=True)  # -> simplify(Tree)
graft_3 = GraftTree(Tree=analysis_id, IncludeEmptyLists=True, IncludeNullItems=True)  # -> simplify(Tree)

poisson_s_ratio_all_loading_modes = Panel(item_12)
axial_surface_shear_modulus_g_0 = Panel(item_17)
axial_shear_modulus_gradient_dg_dz = Panel(item_15)
axial_shear_modulus_below_base_gb = Panel(item_13)
lateral_surface_shear_modulus_g_0 = Panel(item_14)
lateral_shear_modulus_gradient_dg_dz = Panel(item_11)
soil_id = Panel(item_16)
data_6 = Data(soil_id)
num_22 = Number(poisson_s_ratio_all_loading_modes)
num_23 = Number(axial_shear_modulus_gradient_dg_dz)
num_24 = Number(lateral_surface_shear_modulus_g_0)
num_25 = Number(lateral_shear_modulus_gradient_dg_dz)
num_26 = Number(axial_surface_shear_modulus_g_0)
num_27 = Number(axial_shear_modulus_below_base_gb)

graft_4 = GraftTree(Tree=filter, IncludeEmptyLists=True, IncludeNullItems=True)
file_name_s = DataDescription(simplify(graft_4))

dup = DuplicateDataMatch(SourceDataTree=file_name_s, SecondaryData1=int_8)  # -> FileNameS, simplify(SecondaryData1); disabled

duplicate_data = DuplicateDataMatch(SourceDataTree=file_name_s, SecondaryData4=int_10, SecondaryData5=int_9)  # -> FileNameS, SecondaryData1, SecondaryData2, SecondaryData3, SecondaryData4, SecondaryData5

duplicate_data_2 = DuplicateDataMatch(
    SourceDataTree=file_name_s,
    SecondaryData1=data_6,
    SecondaryData2=num_22,
    SecondaryData3=num_26,
    SecondaryData4=num_23,
    SecondaryData5=num_27,
    SecondaryData6=num_24,
    SecondaryData7=num_25)  # -> FileNameS, SecondaryData1, SecondaryData2, SecondaryData3, SecondaryData4, SecondaryData5, SecondaryData6, SecondaryData7
cluster = Cluster(n_iteration=ground_iter, D=soil_id, N=piles_iter, input_if_iter_1=duplicate_data_2.SecondaryData1)
cluster_2 = Cluster(
    n_iteration=ground_iter,
    D=poisson_s_ratio_all_loading_modes,
    N=piles_iter,
    input_if_iter_1=duplicate_data_2.SecondaryData2)
cluster_3 = Cluster(
    n_iteration=ground_iter,
    D=axial_surface_shear_modulus_g_0,
    N=piles_iter,
    input_if_iter_1=duplicate_data_2.SecondaryData3)
cluster_4 = Cluster(
    n_iteration=ground_iter,
    D=axial_shear_modulus_gradient_dg_dz,
    N=piles_iter,
    input_if_iter_1=duplicate_data_2.SecondaryData4)
cluster_5 = Cluster(
    n_iteration=ground_iter,
    D=axial_shear_modulus_below_base_gb,
    N=piles_iter,
    input_if_iter_1=duplicate_data_2.SecondaryData5)
cluster_6 = Cluster(
    n_iteration=ground_iter,
    D=lateral_surface_shear_modulus_g_0,
    N=piles_iter,
    input_if_iter_1=duplicate_data_2.SecondaryData6)
cluster_7 = Cluster(
    n_iteration=ground_iter,
    D=lateral_shear_modulus_gradient_dg_dz,
    N=piles_iter,
    input_if_iter_1=duplicate_data_2.SecondaryData7)

concat_7 = Concatenate(FragmentA=title_of_analysis_from_excel, FragmentE="_it", FragmentD=series_8, FragmentB="_", FragmentC=flatten_2)  # -> simplify(flatten(Result))

concat_8 = Concatenate(FragmentA="\", FragmentB=concat_7, FragmentC="\CHARTS")

concat_9 = Concatenate(FragmentA=file_path, FragmentB=concat_8)
createfolder = CSharpScript(path=concat_9, create=python.a)  # -> out, A, B; inputs path: String, create: Boolean
# ---------- createfolder: C# usings ----------
using System.IO;
using System.Linq;
using System.Data;
using System.Drawing;
using System.Reflection;
using System.Windows.Forms;
using System.Xml;
using System.Xml.Linq;
using System.Runtime.InteropServices;

using Rhino.DocObjects;
using Rhino.Collections;
using GH_IO;
using GH_IO.Serialization;
# ---------- createfolder: C# ----------
    {
      if (create)
      {
        if (!System.IO.Directory.Exists(path))
        {
          System.IO.Directory.CreateDirectory(path);
          A = true; // Set A to true if directory creation is successful
          B = path; // Set B to the created directory path
        }
        else
        {
          A = true; // Set A to false if the directory already exists
          B = path; // Set B to the existing directory path
        }
      }
      else
      {
        A = false; // Set A to false if directory creation is not requested
        B = null; // Set B to null if directory creation is not requested
      }
    }
# ---------- end createfolder ----------

panel_12 = Panel(concat_9)

file_path_2 = FilePath(createfolder.B)
duplicate_2 = DuplicateDataMatch(SourceDataTree=file_name_s, SecondaryData1=file_path_2, SecondaryData2=overwrite_2, SecondaryData3=data_5)  # -> FileNameS, simplify(FilePath), Overwrite, SecondaryData3

python_2 = GhPythonScript(paths=file_path_2)  # -> out, clean_paths; inputs paths: list
# ---------- python_2: Python ----------
__author__ = "Giandomenico.Azzone"
__version__ = "2024.02.21"

import rhinoscriptsyntax as rs
from shutil import copy
from datetime import datetime 

newdiagrams = []
clean_paths = [path[:-7] if path.endswith(r"\CHARTS") else path for path in paths]
print(clean_paths)
# ---------- end python_2 ----------
concat_10 = Concatenate(FragmentA=concat_7, FragmentB=".json")  # -> simplify(flatten(Result))
graft_5 = GraftTree(Tree=flatten(python_2.clean_paths), IncludeEmptyLists=True, IncludeNullItems=True)  # -> simplify(Tree)
graft_6 = GraftTree(Tree=concat_10, IncludeEmptyLists=True, IncludeNullItems=True)
file_name_s_2 = DataDescription(simplify(graft_5))
file_name_s_3 = DataDescription(simplify(graft_6))

panel_13 = Panel(file_name_s_3)

piglet_file = PigletFile(
    NewLocation=file_name_s_2,
    NewName=file_name_s_3,
    OverWrite=duplicate_2.Overwrite,
    SaveAsExcel=duplicate_2.SecondaryData3)
piglet_calcdetails = PigletCalcDetails(
    AnalysisTitle=graft_2,
    AnalysisID=graft_3,
    Description=graft,
    Scope=duplicate_data.SecondaryData4,
    NoPileNodes=duplicate_data.SecondaryData5)
piglet_nlsoildetails = PigletNLSoilDetails(
    HyperbolicConstantF_a=num,
    HyperbolicPowerG_a=num_3,
    NormDispU0d50_l=num_4,
    HyperbolicPowerP_l=num_2,
    NoLoadingSteps=int_7)
piglet_piledetails = PigletPileDetails(Lf=num_7, Epf_a=num_8, Ep_a=num_5, Epf_lx=num_9, Ep_lx=num_10, Epf_ly=num_6, Ep_ly=num_11, TCRatio=num_12, Fixity=num_13)
piglet_soildetails = PigletSoilDetails(
    SoilID=cluster,
    PoissonsRatio=cluster_2,
    G0_a=cluster_3,
    DGDz_a=cluster_4,
    GB=cluster_5,
    G0_l=cluster_6,
    DGDz_l=cluster_7)
piglet_pilegroupgeometry = PigletPileGroupGeometry(
    PileIDList=pile_ids,
    XList=num_18,
    YList=num_17,
    SdList=num_14,
    BdList=num_15,
    ELList=num_16,
    RxzList=num_20,
    RyzList=num_19,
    PSxzList=int_12,
    PSyzList=int_13,
    NoLoadCases=int_11,
    AxialCapacityLimitList=num_21)
piglet_loadcases = PigletLoadCases(
    LoadCaseIDList=load_case_name,
    VList=v_w_kn,
    HxList=h_u_kn_x,
    MxzList=m_q_kn_x_to_z,
    HyList=h_v_knm_y,
    MyzList=m_q_knm_y_to_z,
    MxyList=t_f_knm_x_to_y,
    LTList=load_type)

python_3 = GhPythonScript(x=piglet_file)  # -> out, a; same code as to_read_excel_input
python_4 = GhPythonScript(x=piglet_soildetails)  # -> out, a; same code as to_read_excel_input
python_5 = GhPythonScript(x=piglet_calcdetails)  # -> out, a; same code as to_read_excel_input
python_6 = GhPythonScript(x=piglet_pilegroupgeometry)  # -> out, a; same code as to_read_excel_input
python_7 = GhPythonScript(x=piglet_nlsoildetails)  # -> out, a; same code as to_read_excel_input
python_8 = GhPythonScript(x=piglet_piledetails)  # -> out, a; same code as to_read_excel_input
python_9 = GhPythonScript(x=piglet_loadcases)  # -> out, a; same code as to_read_excel_input
and = GateAnd(
    A=flatten(python_3.a),
    B=flatten(python_4.a),
    C=flatten(python_5.a),
    D=flatten(python_6.a),
    E=flatten(python_7.a),
    F=flatten(python_8.a),
    G=flatten(python_9.a))
to_save_pigro_analysis = ListItem(List=and, Index=0, Wrap=True)

python_10 = GhPythonScript(x=to_save_pigro_analysis)  # -> out, a; same code as to_read_excel_input

panel_14 = Panel(createfolder.A)
panel_15 = Panel(createfolder.B)
and_2 = GateAnd(A=python_10.a, B=panel_14, C=to_read_excel_input.a)
panel_16 = Panel(and_2)

item_20 = ListItem(List=and_2, Index=0, Wrap=True)

bool = Boolean(item_20)

piglet_analyse = PigletAnalyse(
    PigletFile=piglet_file,
    PigletCalcDetails=piglet_calcdetails,
    PigletSoilDetails=piglet_soildetails,
    PigletSoilNLSs=piglet_nlsoildetails,
    PigletPileDetails=piglet_piledetails,
    PigletLoadCasesList=piglet_loadcases,
    PigletPileGroupGeometryList=piglet_pilegroupgeometry,
    PigletJsonVersion=int,
    Analyse=bool)
panel_17 = Panel(piglet_analyse)

panel_18 = Panel("")  # disabled
panel_19 = Panel("")  # disabled
filter_2 = StreamFilter(Gate=to_read_excel_input.a, Stream0=panel_18, Stream1=panel_17)  # disabled
filter_3 = StreamFilter(Gate=to_read_excel_input.a, Stream0=panel_19, Stream1=filter_2)  # disabled
python_11 = GhPythonScript(x=filter_3)  # -> out, a; disabled
# ---------- python_11: Python ----------
__author__ = "Giandomenico.Azzone"
__version__ = "2024.02.21"

import rhinoscriptsyntax as rs

if x == None or x == "":
    a = False
else:
    a = True
# ---------- end python_11 ----------
panel_20 = Panel(python_11.a)  # disabled
item_21 = ListItem(List=flatten(python_11.a), Index=0, Wrap=True)  # disabled
export_piglet_charts = Relay()
plot_piglet_charts = Relay()

# ----
# earthworm output
bool_2 = Boolean(item_21)  # disabled

and_3 = GateAnd(A=to_read_excel_input.a, B=bool_2, C=to_save_pigro_analysis, D=plot_piglet_charts)
and_4 = GateAnd(A=to_read_excel_input.a, B=bool_2, C=to_save_pigro_analysis, D=export_piglet_charts)

# ---- group: launch 1stEXE
python_12 = GhPythonScript(x=and_3)  # -> out, a; disabled
# ---------- python_12: Python ----------
__author__ = "Giandomenico.Azzone"
__version__ = "2024.02.22"

import rhinoscriptsyntax as rs
import subprocess
import os
import Grasshopper
import System


#exe_file2 = exe_position + str("/ExportingCharts.exe")

#print(exe_file)

if x == True:
    
    
    exe_position = code_repo.rsplit('\\DIAGRAMS', 1)[0]
    exe_file = exe_position + str("/WriteJsontoExcel.exe")
    
    # Imposta la directory di lavoro
    os.chdir(code_repo)
    
    # Avvia il processo e attendi che termini
    process = subprocess.Popen(exe_file)
    process.wait()
    process.terminate()
    
    rs.Command("-_Grasshopper_Enter")
    Grasshopper.Instances.DocumentEditor.WindowState = System.Windows.Forms.FormWindowState.Minimized
    
    #os.chdir(code_repo)
    #process = subprocess.Popen(exe_file2)
    #process.wait()
    #rs.Command("Grasshopper")
# ---------- end python_12 ----------

# ---- group: launch 2ndEXE
python_13 = GhPythonScript(x=and_4)  # -> out, a; disabled
# ---------- python_13: Python ----------
__author__ = "Giandomenico.Azzone"
__version__ = "2024.02.22"

import rhinoscriptsyntax as rs
import subprocess
import os
import Grasshopper
import System




#print(exe_file)

if x == True:
    
    # Imposta la directory di lavoro
    os.chdir(code_repo)
    
    exe_position = code_repo.rsplit('\\DIAGRAMS', 1)[0]
    #exe_file = exe_position + str("/WriteJsontoExcel.exe")
    exe_file2 = exe_position + str("/ExportingCharts.exe")
    
    # Avvia il processo e attendi che termini
    #process = subprocess.Popen(exe_file)
    #process.wait()
    #rs.Command("Grasshopper")
    
    process = subprocess.Popen(exe_file2)
    process.wait()
    process.terminate()
    
    rs.Command("-_Grasshopper_Enter")
    
    Grasshopper.Instances.DocumentEditor.WindowState = System.Windows.Forms.FormWindowState.Minimized
# ---------- end python_13 ----------

# ==== cluster Cluster
N = ClusterInput()
D = ClusterInput()
input_if_iter_1 = ClusterInput()
n_iteration = ClusterInput()
dup = DuplicateData(Data=D, Number=N, Order=invert(True))
data = Data(input_if_iter_1)
larger = LargerThan(FirstNumber=n_iteration, SecondNumber="1")  # -> LargerThan, OrEqualTo
graft = GraftTree(Tree=dup, IncludeEmptyLists=True, IncludeNullItems=True)  # -> simplify(Tree)
filter = StreamFilter(Gate=larger.LargerThan, Stream0=data, Stream1=graft)
panel = Panel(filter)
s_0 = ClusterOutput(filter)

# ==== cluster PILES_1
relay = ClusterInput()
i = ClusterInput()
A = ClusterInput()
S = ClusterInput()
N = ClusterInput()
subtraction = Subtraction(A=A, B=1)
series = Series(Start=S, Step=N, Count=subtraction)
i_2 = ClusterInput()

tstat = TreeStatistics(Tree=relay)  # -> Paths, Length, Count
item = ListItem(List=tstat.Paths, Index=i, Wrap=True)
branch = TreeBranch(Tree=relay, Path=item, MaintainPaths=True)

item_2 = ListItem(List=branch, Index=series, Wrap=True)  # -> simplify(flatten(Item))
item_3 = ListItem(List=branch, Index=i_2, Wrap=True)
merge = Merge(Data1=flatten(item_3), Data2=flatten(item_2))
L = ClusterInput()
repeat = RepeatData(Data=flatten(merge), Length=L)
graft = GraftTree(Tree=repeat, IncludeEmptyLists=True, IncludeNullItems=True)  # -> simplify(Tree)
T = ClusterOutput(graft)

# ==== cluster GROUND
A = ClusterInput()
relay = ClusterInput()
i = ClusterInput()
S = ClusterInput()
N = ClusterInput()
subtraction = Subtraction(A=A, B=1)
series = Series(Start=S, Step=N, Count=subtraction)

tstat = TreeStatistics(Tree=relay)  # -> Paths, Length, Count
item = ListItem(List=tstat.Paths, Index=i, Wrap=True)
branch = TreeBranch(Tree=relay, Path=item, MaintainPaths=True)

i_2 = ClusterInput()
item_2 = ListItem(List=branch, Index=series, Wrap=True)  # -> simplify(flatten(Item))
item_3 = ListItem(List=branch, Index=i_2, Wrap=True)
merge = Merge(Data1=flatten(item_3), Data2=flatten(item_2))
L = ClusterInput()
graft = GraftTree(Tree=merge, IncludeEmptyLists=True, IncludeNullItems=True)
repeat = RepeatData(Data=flatten(merge), Length=L)  # disabled
repeat_2 = RepeatData(Data=graft, Length=L)  # -> flatten(Data)
graft_2 = GraftTree(Tree=repeat_2, IncludeEmptyLists=True, IncludeNullItems=True)  # -> simplify(Tree)
T = ClusterOutput(graft_2)
panel = Panel(graft_2)

# ==== cluster PILES_2
A = ClusterInput()
L = ClusterInput()
relay = ClusterInput()
i = ClusterInput()

tstat = TreeStatistics(Tree=relay)  # -> Paths, Length, Count
item = ListItem(List=tstat.Paths, Index=i, Wrap=True)
branch = TreeBranch(Tree=relay, Path=item, MaintainPaths=True)

iter_of_ground = ClusterInput()  # iter of ground
S = ClusterInput()
N = ClusterInput()
subtraction = Subtraction(A=A, B=1)
panel = Panel(branch)
C = ClusterInput()
series = Series(Start=0, Step=1, Count=C)
series_2 = Series(Start=S, Step=N, Count=subtraction)

tstat_2 = TreeStatistics(Tree=relay)  # -> Paths, Length, Count
item_2 = ListItem(List=tstat_2.Paths, Index=series_2, Wrap=True)
branch_2 = TreeBranch(Tree=relay, Path=item_2, MaintainPaths=True)

equals = Equality(FirstNumber=A, SecondNumber=1)  # -> Equality, Inequality
filter = StreamFilter(Gate=equals.Equality, Stream0=branch_2)
stack = StackTrees(Data0=branch, Data1=filter, Reduce=True)
cull_i = CullIndex(List=stack, Indices=series, Wrap=True)  # -> simplify(List)
panel_2 = Panel(filter)
num = Number(cull_i)
clean = CleanTree(RemoveNulls=True, RemoveInvalid=True, RemoveEmpty=invert(False), Tree=num)
len = TextLength(Text=clean)
larger = LargerThan(FirstNumber=len, SecondNumber=0)  # -> LargerThan, OrEqualTo
cull = CullPattern(List=clean, CullPattern=larger.LargerThan)
panel_4 = Panel(cull)
flatten = FlattenTree(Tree=cull, Path="{0}")
lng = ListLength(List=cull)
flatten_2 = FlattenTree(Tree=cull, Path="{0}")  # disabled
dup = DuplicateData(Data=flatten, Number=iter_of_ground, Order=True)
stack_2 = StackTrees(Data0=flatten, Data1=flatten_2, Reduce=True)  # -> flatten(Tree); disabled
repeat = RepeatData(Data=flatten(lng), Length=L)
partition = PartitionList(List=stack_2, Size=repeat)  # -> simplify(Chunks); disabled
partition_2 = PartitionList(List=dup, Size=repeat)  # -> simplify(Chunks)
C_2 = ClusterOutput(partition_2)

# ==== cluster PILES_axialCapacity
L = ClusterInput()
iter_of_ground = ClusterInput()  # iter of ground
C = ClusterInput()
relay = ClusterInput()
i = ClusterInput()
S = ClusterInput()
N = ClusterInput()
A = ClusterInput()
subtraction = Subtraction(A=A, B=1)
num_load_cases = ClusterInput()  # Num Load cases
series = Series(Start=0, Step=1, Count=C)
series_2 = Series(Start=S, Step=N, Count=subtraction)

tstat = TreeStatistics(Tree=relay)  # -> Paths, Length, Count
item = ListItem(List=tstat.Paths, Index=series_2, Wrap=True)
branch = TreeBranch(Tree=relay, Path=item, MaintainPaths=True)

equals = Equality(FirstNumber=A, SecondNumber=1)  # -> Equality, Inequality

tstat_2 = TreeStatistics(Tree=relay)  # -> Paths, Length, Count
item_2 = ListItem(List=tstat_2.Paths, Index=i, Wrap=True)
branch_2 = TreeBranch(Tree=relay, Path=item_2, MaintainPaths=True)

filter = StreamFilter(Gate=equals.Equality, Stream0=branch)
stack = StackTrees(Data0=branch_2, Data1=filter, Reduce=True)
cull_i = CullIndex(List=stack, Indices=series, Wrap=True)  # -> simplify(List)
panel = Panel(cull_i)
int = Integer(cull_i)
clean = CleanTree(RemoveNulls=True, RemoveInvalid=True, RemoveEmpty=invert(False), Tree=int)
len = TextLength(Text=clean)
larger = LargerThan(FirstNumber=len, SecondNumber=0)  # -> LargerThan, OrEqualTo
cull = CullPattern(List=clean, CullPattern=larger.LargerThan)
panel_2 = Panel(cull)
graft = GraftTree(Tree=cull, IncludeEmptyLists=True, IncludeNullItems=True)
repeat = RepeatData(Data=graft, Length=num_load_cases)  # -> simplify(Data)
panel_3 = Panel(repeat)
trim = TrimTree(Tree=repeat, Depth=1)
lng = ListLength(List=trim)
dup = DuplicateData(Data=flatten(trim), Number=iter_of_ground, Order=True)
repeat_2 = RepeatData(Data=flatten(lng), Length=L)
panel_4 = Panel(repeat_2)
partition = PartitionList(List=dup, Size=repeat_2)  # -> simplify(Chunks)
panel_5 = Panel(partition)
filter_2 = StreamFilter(Gate=equals.Equality, Stream0=partition, Stream1=flatten(repeat))
s_0 = ClusterOutput(filter_2)

# ==== cluster PILES_ProfileSwitches
relay = ClusterInput()
i = ClusterInput()
A = ClusterInput()

tstat = TreeStatistics(Tree=relay)  # -> Paths, Length, Count
item = ListItem(List=tstat.Paths, Index=i, Wrap=True)
branch = TreeBranch(Tree=relay, Path=item, MaintainPaths=True)

panel = Panel("20")
S = ClusterInput()
N = ClusterInput()
subtraction = Subtraction(A=A, B=1)
series = Series(Start=S, Step=N, Count=subtraction)
i_2 = ClusterInput()
item_2 = ListItem(List=branch, Index=series, Wrap=True)  # -> simplify(flatten(Item))
item_3 = ListItem(List=branch, Index=i_2, Wrap=True)
merge = Merge(Data1=flatten(item_3), Data2=flatten(item_2))
panel_2 = Panel(branch)
L = ClusterInput()
repeat = RepeatData(Data=flatten(merge), Length=L)
graft = GraftTree(Tree=repeat, IncludeEmptyLists=True, IncludeNullItems=True)  # -> simplify(Tree)
T = ClusterOutput(graft)

# ==== cluster LOAD_CASE_New
C = ClusterInput()
relay = ClusterInput()
i = ClusterInput()

tstat = TreeStatistics(Tree=relay)  # -> Paths, Length, Count
item = ListItem(List=tstat.Paths, Index=i, Wrap=True)
branch = TreeBranch(Tree=relay, Path=item, MaintainPaths=True)

series = Series(Start=0, Step=1, Count=C)
cull_i = CullIndex(List=branch, Indices=series, Wrap=True)
python = GhPythonScript(x=cull_i)  # -> out, merged_list, len_list; inputs x: list
# ---------- python: Python ----------
__author__ = "Giandomenico.Azzone"
__version__ = "2024.03.01"

import rhinoscriptsyntax as rs

filtered_groups = []
current_group = []

for item in x:
    if item in [None, "Load case name",""]:
        if current_group:  
            filtered_groups.append(current_group)
            current_group = []  
    else:
        current_group.append(item)

if current_group:  
    filtered_groups.append(current_group)

merged_list = [item for group in filtered_groups for item in group]
len_list = []
for i in filtered_groups:
    len_list.append(len(i))

print(filtered_groups)  
print(merged_list)
# ---------- end python ----------
no_piles_iterat = ClusterInput()  # no piles iterat
partition = PartitionList(List=python.merged_list, Size=python.len_list)  # -> simplify(Chunks)
series_2 = Series(Start=0, Step=1, Count=no_piles_iterat)
tstat_2 = TreeStatistics(Tree=partition)  # -> Paths, Length, Count
item_2 = ListItem(List=tstat_2.Paths, Index=series_2, Wrap=True)
branch_2 = TreeBranch(Tree=partition, Path=item_2, MaintainPaths=True)
B = ClusterOutput(branch_2)
panel = Panel(branch_2)

# ==== cluster LOAD_CASE_New_2
C = ClusterInput()
relay = ClusterInput()
i = ClusterInput()

tstat = TreeStatistics(Tree=relay)  # -> Paths, Length, Count
item = ListItem(List=tstat.Paths, Index=i, Wrap=True)
branch = TreeBranch(Tree=relay, Path=item, MaintainPaths=True)

series = Series(Start=0, Step=1, Count=C)
cull_i = CullIndex(List=branch, Indices=series, Wrap=True)
python = GhPythonScript(x=cull_i)  # -> out, merged_list, len_list; inputs x: list
# ---------- python: Python ----------
__author__ = "Giandomenico.Azzone"
__version__ = "2024.03.01"

import rhinoscriptsyntax as rs

filtered_groups = []
current_group = []

for item in x:
    if item in [None, "Load case name","","[kN]", "V (w)"]:
        if current_group:  
            filtered_groups.append(current_group)
            current_group = []  
    else:
        current_group.append(item)

if current_group:  
    filtered_groups.append(current_group)

merged_list = [item for group in filtered_groups for item in group]
len_list = []
for i in filtered_groups:
    len_list.append(len(i))

print(filtered_groups)  
print(merged_list)
# ---------- end python ----------
no_piles_iterat = ClusterInput()  # no piles iterat
partition = PartitionList(List=python.merged_list, Size=python.len_list)  # -> simplify(Chunks)
series_2 = Series(Start=0, Step=1, Count=no_piles_iterat)
tstat_2 = TreeStatistics(Tree=partition)  # -> Paths, Length, Count
item_2 = ListItem(List=tstat_2.Paths, Index=series_2, Wrap=True)
branch_2 = TreeBranch(Tree=partition, Path=item_2, MaintainPaths=True)
B = ClusterOutput(branch_2)
panel = Panel(branch_2)

# ==== cluster LOAD_CASE_New_3
C = ClusterInput()
relay = ClusterInput()
i = ClusterInput()

tstat = TreeStatistics(Tree=relay)  # -> Paths, Length, Count
item = ListItem(List=tstat.Paths, Index=i, Wrap=True)
branch = TreeBranch(Tree=relay, Path=item, MaintainPaths=True)

series = Series(Start=0, Step=1, Count=C)
cull_i = CullIndex(List=branch, Indices=series, Wrap=True)
python = GhPythonScript(x=cull_i)  # -> out, merged_list, len_list; inputs x: list
# ---------- python: Python ----------
__author__ = "Giandomenico.Azzone"
__version__ = "2024.03.01"

import rhinoscriptsyntax as rs

filtered_groups = []
current_group = []

for item in x:
    if item in [None, "Load case name","","[kN]", "H (u)"]:
        if current_group:  
            filtered_groups.append(current_group)
            current_group = []  
    else:
        current_group.append(item)

if current_group:  
    filtered_groups.append(current_group)

merged_list = [item for group in filtered_groups for item in group]
len_list = []
for i in filtered_groups:
    len_list.append(len(i))

print(filtered_groups)  
print(merged_list)
# ---------- end python ----------
no_piles_iterat = ClusterInput()  # no piles iterat
partition = PartitionList(List=python.merged_list, Size=python.len_list)  # -> simplify(Chunks)
series_2 = Series(Start=0, Step=1, Count=no_piles_iterat)
tstat_2 = TreeStatistics(Tree=partition)  # -> Paths, Length, Count
item_2 = ListItem(List=tstat_2.Paths, Index=series_2, Wrap=True)
branch_2 = TreeBranch(Tree=partition, Path=item_2, MaintainPaths=True)
B = ClusterOutput(branch_2)
panel = Panel(branch_2)

# ==== cluster LOAD_CASE_New_4
C = ClusterInput()
relay = ClusterInput()
i = ClusterInput()

tstat = TreeStatistics(Tree=relay)  # -> Paths, Length, Count
item = ListItem(List=tstat.Paths, Index=i, Wrap=True)
branch = TreeBranch(Tree=relay, Path=item, MaintainPaths=True)

series = Series(Start=0, Step=1, Count=C)
cull_i = CullIndex(List=branch, Indices=series, Wrap=True)
python = GhPythonScript(x=cull_i)  # -> out, merged_list, len_list; inputs x: list
# ---------- python: Python ----------
__author__ = "Giandomenico.Azzone"
__version__ = "2024.03.01"

import rhinoscriptsyntax as rs

filtered_groups = []
current_group = []

for item in x:
    if item in [None, "Load case name","","[kN]", "M (q)"]:
        if current_group:  
            filtered_groups.append(current_group)
            current_group = []  
    else:
        current_group.append(item)

if current_group:  
    filtered_groups.append(current_group)

merged_list = [item for group in filtered_groups for item in group]
len_list = []
for i in filtered_groups:
    len_list.append(len(i))

print(filtered_groups)  
print(merged_list)
# ---------- end python ----------
no_piles_iterat = ClusterInput()  # no piles iterat
partition = PartitionList(List=python.merged_list, Size=python.len_list)  # -> simplify(Chunks)
series_2 = Series(Start=0, Step=1, Count=no_piles_iterat)
tstat_2 = TreeStatistics(Tree=partition)  # -> Paths, Length, Count
item_2 = ListItem(List=tstat_2.Paths, Index=series_2, Wrap=True)
branch_2 = TreeBranch(Tree=partition, Path=item_2, MaintainPaths=True)
B = ClusterOutput(branch_2)
panel = Panel(branch_2)

# ==== cluster LOAD_CASE_New_5
C = ClusterInput()
relay = ClusterInput()
i = ClusterInput()

tstat = TreeStatistics(Tree=relay)  # -> Paths, Length, Count
item = ListItem(List=tstat.Paths, Index=i, Wrap=True)
branch = TreeBranch(Tree=relay, Path=item, MaintainPaths=True)

series = Series(Start=0, Step=1, Count=C)
cull_i = CullIndex(List=branch, Indices=series, Wrap=True)
python = GhPythonScript(x=cull_i)  # -> out, merged_list, len_list; inputs x: list
# ---------- python: Python ----------
__author__ = "Giandomenico.Azzone"
__version__ = "2024.03.01"

import rhinoscriptsyntax as rs

filtered_groups = []
current_group = []

for item in x:
    if item in [None, "Load case name","","[kNm]", "H (v)"]:
        if current_group:  
            filtered_groups.append(current_group)
            current_group = []  
    else:
        current_group.append(item)

if current_group:  
    filtered_groups.append(current_group)

merged_list = [item for group in filtered_groups for item in group]
len_list = []
for i in filtered_groups:
    len_list.append(len(i))

print(filtered_groups)  
print(merged_list)
# ---------- end python ----------
no_piles_iterat = ClusterInput()  # no piles iterat
partition = PartitionList(List=python.merged_list, Size=python.len_list)  # -> simplify(Chunks)
series_2 = Series(Start=0, Step=1, Count=no_piles_iterat)
tstat_2 = TreeStatistics(Tree=partition)  # -> Paths, Length, Count
item_2 = ListItem(List=tstat_2.Paths, Index=series_2, Wrap=True)
branch_2 = TreeBranch(Tree=partition, Path=item_2, MaintainPaths=True)
B = ClusterOutput(branch_2)
panel = Panel(branch_2)

# ==== cluster LOAD_CASE_New_6
C = ClusterInput()
relay = ClusterInput()
i = ClusterInput()

tstat = TreeStatistics(Tree=relay)  # -> Paths, Length, Count
item = ListItem(List=tstat.Paths, Index=i, Wrap=True)
branch = TreeBranch(Tree=relay, Path=item, MaintainPaths=True)

series = Series(Start=0, Step=1, Count=C)
cull_i = CullIndex(List=branch, Indices=series, Wrap=True)
python = GhPythonScript(x=cull_i)  # -> out, merged_list, len_list; inputs x: list
# ---------- python: Python ----------
__author__ = "Giandomenico.Azzone"
__version__ = "2024.03.01"

import rhinoscriptsyntax as rs

filtered_groups = []
current_group = []

for item in x:
    if item in [None, "Load case name","","[kNm]", "M (q)"]:
        if current_group:  
            filtered_groups.append(current_group)
            current_group = []  
    else:
        current_group.append(item)

if current_group:  
    filtered_groups.append(current_group)

merged_list = [item for group in filtered_groups for item in group]
len_list = []
for i in filtered_groups:
    len_list.append(len(i))

print(filtered_groups)  
print(merged_list)
# ---------- end python ----------
no_piles_iterat = ClusterInput()  # no piles iterat
partition = PartitionList(List=python.merged_list, Size=python.len_list)  # -> simplify(Chunks)
series_2 = Series(Start=0, Step=1, Count=no_piles_iterat)
tstat_2 = TreeStatistics(Tree=partition)  # -> Paths, Length, Count
item_2 = ListItem(List=tstat_2.Paths, Index=series_2, Wrap=True)
branch_2 = TreeBranch(Tree=partition, Path=item_2, MaintainPaths=True)
B = ClusterOutput(branch_2)
panel = Panel(branch_2)

# ==== cluster LOAD_CASE_New_7
C = ClusterInput()
relay = ClusterInput()
i = ClusterInput()

tstat = TreeStatistics(Tree=relay)  # -> Paths, Length, Count
item = ListItem(List=tstat.Paths, Index=i, Wrap=True)
branch = TreeBranch(Tree=relay, Path=item, MaintainPaths=True)

series = Series(Start=0, Step=1, Count=C)
cull_i = CullIndex(List=branch, Indices=series, Wrap=True)
python = GhPythonScript(x=cull_i)  # -> out, merged_list, len_list; inputs x: list
# ---------- python: Python ----------
__author__ = "Giandomenico.Azzone"
__version__ = "2024.03.01"

import rhinoscriptsyntax as rs

filtered_groups = []
current_group = []

for item in x:
    if item in [None, "Load case name","","[kNm]", "T (f)"]:
        if current_group:  
            filtered_groups.append(current_group)
            current_group = []  
    else:
        current_group.append(item)

if current_group:  
    filtered_groups.append(current_group)

merged_list = [item for group in filtered_groups for item in group]
len_list = []
for i in filtered_groups:
    len_list.append(len(i))

print(filtered_groups)  
print(merged_list)
# ---------- end python ----------
no_piles_iterat = ClusterInput()  # no piles iterat
partition = PartitionList(List=python.merged_list, Size=python.len_list)  # -> simplify(Chunks)
series_2 = Series(Start=0, Step=1, Count=no_piles_iterat)
tstat_2 = TreeStatistics(Tree=partition)  # -> Paths, Length, Count
item_2 = ListItem(List=tstat_2.Paths, Index=series_2, Wrap=True)
branch_2 = TreeBranch(Tree=partition, Path=item_2, MaintainPaths=True)
B = ClusterOutput(branch_2)
panel = Panel(branch_2)

# ==== cluster LOAD_CASE_New_8
C = ClusterInput()
relay = ClusterInput()
i = ClusterInput()

tstat = TreeStatistics(Tree=relay)  # -> Paths, Length, Count
item = ListItem(List=tstat.Paths, Index=i, Wrap=True)
branch = TreeBranch(Tree=relay, Path=item, MaintainPaths=True)

series = Series(Start=0, Step=1, Count=C)
cull_i = CullIndex(List=branch, Indices=series, Wrap=True)
python = GhPythonScript(x=cull_i)  # -> out, merged_list, len_list; inputs x: list
# ---------- python: Python ----------
__author__ = "Giandomenico.Azzone"
__version__ = "2024.03.01"

import rhinoscriptsyntax as rs

filtered_groups = []
current_group = []

for item in x:
    if item in [None, "Load case name","","[kN]", "M (q)", "Loading type"]:
        if current_group:  
            filtered_groups.append(current_group)
            current_group = []  
    else:
        current_group.append(item)

if current_group:  
    filtered_groups.append(current_group)

merged_list = [item for group in filtered_groups for item in group]
len_list = []
for i in filtered_groups:
    len_list.append(len(i))

print(filtered_groups)  
print(merged_list)
# ---------- end python ----------
no_piles_iterat = ClusterInput()  # no piles iterat
partition = PartitionList(List=python.merged_list, Size=python.len_list)  # -> simplify(Chunks)
series_2 = Series(Start=0, Step=1, Count=no_piles_iterat)
tstat_2 = TreeStatistics(Tree=partition)  # -> Paths, Length, Count
item_2 = ListItem(List=tstat_2.Paths, Index=series_2, Wrap=True)
branch_2 = TreeBranch(Tree=partition, Path=item_2, MaintainPaths=True)
B = ClusterOutput(branch_2)
panel = Panel(branch_2)
