# Grasshopper definition Modification.gh (Grasshopper 1.0.7)
# plug-ins: PancakeSpreadsheet

c_script = CSharpScript()  # -> curFldr, separatorChar
# ---------- c_script: C# ----------
    curFldr = System.IO.Path.GetDirectoryName(GrasshopperDocument.FilePath);
    separatorChar = System.IO.Path.DirectorySeparatorChar;
# ---------- end c_script ----------
concat = Concatenate(FragmentA=c_script.curFldr, FragmentB=c_script.separatorChar, FragmentC="Demo1.xlsx")
concat_2 = Concatenate(FragmentA=c_script.curFldr, FragmentB=c_script.separatorChar, FragmentC="Demo1_changed.xlsx")
psopenspreadsheet = OpenSpreadsheet(File=concat, OpenMode=0, OK=True)
psgetsheet = GetSheet(Spreadsheet=psopenspreadsheet, Identifier="Sheet1")
psgetcell = GetCell(Sheet=psgetsheet, Cell="B2", Type=0)
psgetcell_2 = GetCell(Sheet=psgetsheet, Cell="C2", Type=0)
psgetcell_3 = GetCell(Sheet=psgetsheet, Cell="D2", Type=0)
final_price_of_apple_before_modification = Panel(psgetcell_3)  # "Final Price of Apple (before modification, result of formula)"
original_price = Panel(psgetcell)
discount_before_modification = Panel(psgetcell_2)

# ---- group: Flow control components are required to if you mix read/write actions.
pswaituntil = WaitUntil(Signal=[psgetsheet, psgetcell_3, psgetcell_2, psgetcell], Data=psgetsheet)

# ---- group: Convert to numbers first if you want it to be treated as numbers
num = Number("0.5")

# ----
pssetcell = SetCell(Sheet=pswaituntil, Cell="C2", Type=0, Content=num)
psgetcell_4 = GetCell(Sheet=pssetcell, Cell="C2", Type=0)
psgetcell_5 = GetCell(Sheet=pssetcell, Cell="D2", Type=0)
final_price_of_apple_after_modification = Panel(psgetcell_5)  # "Final Price of Apple (after modification, result of formula)"
discount_after_modification = Panel(psgetcell_4)
pswaituntil_2 = WaitUntil(Signal=[psgetcell_5, psgetcell_4], Data=psopenspreadsheet)

# ---- group: The spreadsheet needs to be recomputed to reflect changes in formula result.
psrecompute = Recompute(Spreadsheet=pswaituntil_2)

# ----
pswaituntil_3 = WaitUntil(Signal=psrecompute, Data=pssetcell)
pswaituntil_4 = WaitUntil(Signal=psrecompute, Data=psopenspreadsheet)
psgetcell_6 = GetCell(Sheet=pswaituntil_3, Cell="D2", Type=0)
final_price_of_apple_after_modification_2 = Panel(psgetcell_6)  # "Final Price of Apple (after modification, after recomputation)"
# Spreadsheet will always be recomputed during saving.
# That is to say, if you don't need the recomputed result,
# or your modification doesn't affect formulas,
# you can omit the "Recompute" component.
pssavespreadsheet = SaveSpreadsheet(Spreadsheet=pswaituntil_4, File=concat_2, Overwrite=Toggle(True), OK=Toggle(False))
