# Grasshopper definition Create Excel file.gh (Grasshopper 1.0.7)
# plug-ins: PancakeSpreadsheet

# ---- group: The input specifies which to create, XLSX/XLS, by default XLSX.
pscreatespreadsheet = CreateSpreadsheet(Type=0)

# ---- group: Remember to create a sheet in an empty spreadsheet file
pscreatesheet = CreateSheet(Spreadsheet=pscreatespreadsheet, Name="TestSheet1")

# ---- group: "A1" or "R1C1" notations are accepted.
panel = Panel("A2")

# ----
pssetcell = SetCell(Sheet=pscreatesheet, Cell=panel, Type=0, Content="Test Text")

# ---- group: If you are to modify the spreadsheet, you MUST use flow control components to make sure read/write actions are correctly ordered.
pswaituntil = WaitUntil(Signal=pssetcell, Data=pscreatespreadsheet)

# ----
pssavespreadsheet = SaveSpreadsheet(Spreadsheet=pswaituntil, File="E:\Gan\TestOutput.xlsx", Overwrite=Toggle(True), OK=Toggle(False))
