# Grasshopper definition Read.gh (Grasshopper 1.0.7)
# plug-ins: PancakeSpreadsheet

c_script = CSharpScript()  # -> curFldr, separatorChar
# ---------- c_script: C# ----------
    curFldr = System.IO.Path.GetDirectoryName(GrasshopperDocument.FilePath);
    separatorChar = System.IO.Path.DirectorySeparatorChar;
# ---------- end c_script ----------
concat = Concatenate(FragmentA=c_script.curFldr, FragmentB=c_script.separatorChar, FragmentC="Demo1.xlsx")
psopenspreadsheet = OpenSpreadsheet(File=concat, OpenMode=0, OK=True)
pssheetlist = SheetList(Spreadsheet=psopenspreadsheet)  # -> Sheets, SheetVisbilities, ActiveSheetIndex
psgetsheet = GetSheet(Spreadsheet=psopenspreadsheet, Identifier="Sheet1")
panel = Panel(pssheetlist.Sheets)

# ---- group: Get the entire data area. You can also specify it manually.
pssheetentirerange = SheetEntireRange(Sheet=psgetsheet)

# ---- group: Row First
psgetmulticells = GetMultipleCells(Sheet=psgetsheet, CellRange=pssheetentirerange, Type=0, RowFirst=Toggle(True))

# ---- group: Column First
psgetmulticells_2 = GetMultipleCells(Sheet=psgetsheet, CellRange=pssheetentirerange, Type=0, RowFirst=Toggle(False))

# ----
panel_2 = Panel(psgetmulticells_2)
panel_3 = Panel(psgetmulticells)
item = ListItem(List=psgetmulticells, Index=Slider(0, range=0..100), Wrap=True)  # -> flatten(Item)
item_2 = ListItem(List=psgetmulticells, Index=Slider(1, range=0..1), Wrap=True)  # -> flatten(Item)
cull_i = CullIndex(List=item, Indices=Slider(0, range=0..100), Wrap=True)
cull_i_2 = CullIndex(List=item_2, Indices=Slider(0, range=0..100), Wrap=True)
panel_4 = Panel(cull_i)
panel_5 = Panel(cull_i_2)
