# Grasshopper definition Simple read and write.gh (Grasshopper 1.0.7)
# plug-ins: PancakeSpreadsheet

# ----
# Simple Read
panel = Panel("Demo1.xlsx")
c_script = CSharpScript()  # -> curFldr, separatorChar
# ---------- c_script: C# ----------
    curFldr = System.IO.Path.GetDirectoryName(GrasshopperDocument.FilePath);
    separatorChar = System.IO.Path.DirectorySeparatorChar;
# ---------- end c_script ----------
concat = Concatenate(FragmentA=c_script.curFldr, FragmentB=c_script.separatorChar, FragmentC=panel)
pssimpleread = SimpleReadXLS(File=concat, RowFirst=True, OK=Toggle(True))
panel_2 = Panel(pssimpleread)

# ----
# Pancake writes data as it is.
# If the data goes through a Panel,
# it will become text.
# |
# |
# |
# |
# |
# |
# |
# |
# |
# |
# v
# Different from many other plugins,
# appending row/column labels
# is done by a separated component,
# to provide maximum flexibility.
# |
# |
# v
# Simple Write
panel_3 = Panel("DemoWrite.xlsx")
series = Series(Start=0, Step=1, Count=10)
concat_2 = Concatenate(FragmentA=c_script.curFldr, FragmentB=c_script.separatorChar, FragmentC=panel_3)
partition = PartitionList(List=series, Size=Slider(3, range=0..10))
panel_4 = Panel(partition)
panel_5 = Panel("""Column1
Column2
ColumnWhatever""")
int = Integer(panel_4)
psappendlabels = AppendLabels(Data=int, RowFirst=True, ColumnLabels=panel_5)
always_create_a_new_spreadsheet_instead = BooleanToggle(True)  # "Always create a new spreadsheet, instead of modifying existing spreadsheet file."
pssimplewritetable = SimpleWriteTreeToXLS(
    File=concat_2,
    SheetIdentifier="Sheet1",
    Data=psappendlabels,
    RowFirst=True,
    ResizeColumn=True,
    CreateNew=always_create_a_new_spreadsheet_instead,
    IgnoreNull=False,
    OK=Button())
